# Grasshopper definition appendix_g_sample.gh (Grasshopper 1.0.7)
# plug-ins: PollinationGH

# ----
# Closed Office
offices = Geometry([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])
room2d = DFRoom2D(geo=flatten(offices), flr_to_ceiling="3", name="Office", program="2019::LargeOffice::ClosedOffice")  # -> report, room2d; plug-in component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

# ----
# Corridor
corridor = Geometry([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])
room2d_2 = DFRoom2D(geo=flatten(corridor), flr_to_ceiling="4", name="Corridor", program="2019::LargeOffice::Corridor")  # -> report, room2d; plug-in component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

# ----
# Conference
panel = Panel("Conference")
conference = Geometry([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])
room2d_3 = DFRoom2D(geo=flatten(conference), flr_to_ceiling="4", name=panel, program="2019::LargeOffice::Conference")  # -> report, room2d; plug-in component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

# ----
# Classroom
panel_2 = Panel("Classroom")
classroom = Geometry([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])
room2d_4 = DFRoom2D(geo=flatten(classroom), flr_to_ceiling="4.5", name=panel_2, program="2019::LargeOffice::Classroom")  # -> report, room2d; plug-in component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

# ----
# Storage
panel_3 = Panel("2019::LargeOffice::Storage")
storage = Geometry([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])
room2d_5 = DFRoom2D(geo=flatten(storage), flr_to_ceiling="3.5", name="Storage", program=panel_3, conditioned=Toggle(False))  # -> report, room2d; plug-in component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

# ----
# Open Office
open_office = Geometry([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])
room2d_6 = DFRoom2D(geo=flatten(open_office), flr_to_ceiling="3.5", name="Writeup", program="2019::LargeOffice::OpenOffice")  # -> report, room2d; plug-in component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

# ----
# Solve Adjacency and Join Stories
room2dattr = DFRoom2DAttributes({"Display Name": "display_name", "Simulation Name (Identifier)": "identifier", "Floor-To-Ceiling Height": "floor_to_ceiling_height", "Floor Elevation": "floor_height", "Ceiling Elevation": "ceiling_height", "Is Ground Contact": "is_ground_contact"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}, selected="Floor Elevation")
allroom2ds = Data(flatten([room2d.room2d, room2d_6.room2d, room2d_3.room2d, room2d_4.room2d, room2d_2.room2d, room2d_5.room2d]))
room2dsbyattr = DFRoom2DsByAttribute(df_obj=flatten(allroom2ds), attribute=room2dattr)  # -> values, room2ds; plug-in component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
solveadj2d = DFSolveAdjacency(df_objs=room2dsbyattr.room2ds, run=Toggle(True))  # -> report, df_objs; plug-in component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
panel_4 = Panel("""Plinth
Middle
Tower""")
panel_5 = Panel("""4
6
10""")
story = DFStory(room2ds=simplify(solveadj2d.df_objs), name=simplify(graft(panel_4)), multiplier=simplify(graft(panel_5)))  # -> report, flatten(story); plug-in component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

# ----
# Triple Glazed Construction Set
panel_6 = Panel("Triple Glazed_U025_SHGC30")
bldgvintages = HBBuildingVintages({"ASHRAE 90.1 2019  |  IECC 2021": "2019", "ASHRAE 90.1 2016  |  IECC 2018": "2016", "ASHRAE 90.1 2013  |  IECC 2015": "2013", "ASHRAE 90.1 2010  |  IECC 2012": "2010", "ASHRAE 90.1 2007  |  IECC 2009": "2007", "ASHRAE 90.1 2004  |  IECC 2006": "2004", "1980-2004 (CBECS)": "1980_2004", "Pre-1980 (CBECS)": "pre_1980"}, selected="ASHRAE 90.1 2019  |  IECC 2021")
constr_type = Dragonfly_BldgAge({"SteelFramed", "WoodFramed", "Mass", "Metal Building"}, selected="SteelFramed")
climate_zone = Dragonfly_BldgAge({"1 - Very Hot": "1", "2 - Hot": "2", "3 - Warm": "3", "4 - Mixed": "4", "5 - Cool": "5", "6 - Cold": "6", "7 - Very Cold": "7", "8 - Subarctic": "8"}, selected="5 - Cool")
windowmat = HBWindowMaterial(name=panel_6, u_factor="1.25", shgc="0.3")  # -> mat; plug-in component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
constrsetclimate = HBConstructionSetByClimate(climate_zone=climate_zone, vintage=bldgvintages, constr_type=constr_type)  # -> constr_set; plug-in component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
windowconstr = HBWindowConstruction(name=panel_6, materials=windowmat)  # -> constr; plug-in component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
subfacesubset = HBSubfaceSubset(window=windowconstr, skylight=windowconstr)  # -> subface_set; plug-in component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
constructionset = HBConstructionSet(name="High Performance - Climate Zone 5", base_constr_set=constrsetclimate, subface_subset=subfacesubset)  # -> constr_set; plug-in component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

# ----
# Add Windows
panel_7 = Panel("0.15")
facparam = HBFacadeParameters(north="0.4", east=panel_7, south="0.45", west="0.15")  # -> fac_par; plug-in component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
simpleratiopar = DFSimpleWindowRatioParameters(ratio=facparam)  # -> win_par; plug-in component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
applyfacadepar = DFApplyFacadeParameters(df_obj=flatten(story.story), win_par=simpleratiopar)  # -> report, df_obj; plug-in component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

# ----
# Create a Building
panel_8 = Panel("Science Center")
buildingstories = DFBuildingFromStories(stories=applyfacadepar.df_obj, name=panel_8, constr_set=constructionset)  # -> report, building; plug-in component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

# ----
# Create HVAC
doas = HBDOASHVACTemplates({"DOAS with fan coil chiller with boiler": "DOAS_FCU_Chiller_Boiler", "DOAS with fan coil chiller with central air source heat pump": "DOAS_FCU_Chiller_ASHP", "DOAS with fan coil chiller with district hot water": "DOAS_FCU_Chiller_DHW", "DOAS with fan coil chiller with baseboard electric": "DOAS_FCU_Chiller_ElectricBaseboard", "DOAS with fan coil chiller with gas unit heaters": "DOAS_FCU_Chiller_GasHeaters", "DOAS with fan coil chiller with no heat": "DOAS_FCU_Chiller", "DOAS with fan coil air-cooled chiller with boiler": "DOAS_FCU_ACChiller_Boiler", "DOAS with fan coil air-cooled chiller with central air source heat pump": "DOAS_FCU_ACChiller_ASHP", "DOAS with fan coil air-cooled chiller with district hot water": "DOAS_FCU_ACChiller_DHW", "DOAS with fan coil air-cooled chiller with baseboard electric": "DOAS_FCU_ACChiller_ElectricBaseboard"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}, selected="DOAS with fan coil chiller with central air source heat pump")
panel_9 = Panel("""0
0
0
0
0
0
0
1
1
1
1
1
1
1
1
1
1
1
1
1
0
0
0
0""")
bldgvintages_2 = HBBuildingVintages({"ASHRAE 90.1 2019  |  IECC 2021": "2019", "ASHRAE 90.1 2016  |  IECC 2018": "2016", "ASHRAE 90.1 2013  |  IECC 2015": "2013", "ASHRAE 90.1 2010  |  IECC 2012": "2010", "ASHRAE 90.1 2007  |  IECC 2009": "2007", "ASHRAE 90.1 2004  |  IECC 2006": "2004", "1980-2004 (CBECS)": "1980_2004", "Pre-1980 (CBECS)": "pre_1980"}, selected="ASHRAE 90.1 2019  |  IECC 2021")
constantschedule = HBConstantSchedule(values=panel_9, name="DOAS Nighttime Shutoff")  # -> report, schedule, idf_text; plug-in component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
dfdoashvac = DFDOASHVAC(
    df_objs=flatten(buildingstories.building),
    system_type=doas,
    vintage=bldgvintages_2,
    name="FCU_DOAS_Enthalpy_Wheel",
    sensible_hr="0.81",
    latent_hr="0.76",
    dcv=Toggle(True),
    doas_avail_sch=constantschedule.schedule)  # -> report, df_objs; plug-in component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

geo = Geometry([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])
context = DFContextShade(geo=geo)  # -> report, context; plug-in component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

# ----
# Download EPW File
panel_10 = Panel("https://energyplus-weather.s3.amazonaws.com/north_and_central_america_wmo_region_4/USA/MA/USA_MA_Boston-Logan.Intl.AP.725090_TMY3/USA_MA_Boston-Logan.Intl.AP.725090_TMY3.zip")
downloadepw = LBDownloadWeather(weather_URL=panel_10)  # -> epw_file, stat_file, ddy_file; plug-in component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
importloc = LBImportLocation(epw_file=downloadepw.epw_file)  # -> location; plug-in component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

importstat = LBImportSTAT(stat_file=downloadepw.stat_file)  # -> location, ashrae_zone, koppen_zone, clear_dir_norm_rad, clear_diff_horiz_rad, ann_heat_dday_996, ann_heat_dday_990, ann_cool_dday_004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; plug-in component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
bldgvintages_3 = HBBuildingVintages({"ASHRAE 90.1 2019  |  IECC 2021": "2019", "ASHRAE 90.1 2016  |  IECC 2018": "2016", "ASHRAE 90.1 2013  |  IECC 2015": "2013", "ASHRAE 90.1 2010  |  IECC 2012": "2010", "ASHRAE 90.1 2007  |  IECC 2009": "2007", "ASHRAE 90.1 2004  |  IECC 2006": "2004", "1980-2004 (CBECS)": "1980_2004", "Pre-1980 (CBECS)": "pre_1980"}, selected="ASHRAE 90.1 2019  |  IECC 2021")
bldgprograms = HBBuildingPrograms({"LargeOffice", "MediumOffice", "SmallOffice", "MidriseApartment", "HighriseApartment", "Retail", "StripMall", "PrimarySchool", "SecondarySchool", "SmallHotel", "LargeHotel", "Hospital", "Outpatient", "Laboratory", "Warehouse", "SuperMarket", "FullServiceRestaurant", "QuickServiceRestaurant", "Courthouse", "LargeDataCenterHighITE", "LargeDataCenterLowITE", "SmallDataCenterHighITE", "SmallDataCenterLowITE"}, selected="LargeOffice")
txt = Text("CLOUD:ladybug-tools/demo/dfd39e2d-9d4e-4e41-bc8d-683f3c3ebe27")
check_study_status = CheckStudyStatus(_study=txt, Index_=0, getBothInputOutputAssets=False, liveUpdateStatus=True)  # -> Status, Run
check_run_results = CheckRunResults(
    _run=check_study_status.Run,
    recipeSource="https://api.pollination.cloud/registries/pollination/recipe/appendix-g-performance/0.3.1")  # -> G_report, BaselineModel, Baseline_sqls, Leed_summary, ProposedSql
load_assets = LoadAssets(
    G_report=check_run_results.G_report,
    Leed_summary=check_run_results.Leed_summary,
    ProposedSql=check_run_results.ProposedSql,
    liveUpdateStatus=True,
    postprocessWithHandler=True,
    useCachedAssets=True)  # -> Logs, G_report, Leed_summary, ProposedSql, Value_4
tsort = SortText(Keys=load_assets.G_report, Culture=127)  # -> Keys, Values
tsort_2 = SortText(Keys=load_assets.Leed_summary, Culture=127)  # -> Keys, Values

eui = HBEndUseIntensity(sql=load_assets.ProposedSql)  # -> eui, eui_end_use, end_uses, gross_floor; plug-in component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
panel_11 = Panel(eui.eui_end_use)
panel_12 = Panel(eui.end_uses)

item = ListItem(List=tsort_2.Keys, Index="6", Wrap=True)
appendix_g_performance_in_ashrae_90_1_20 = Panel(tsort.Keys)  # "Appendix G Performance in ASHRAE 90.1 2016/2019/2022"
leed_v4_summary = Panel(tsort_2.Keys)
leed_points = Panel(item)

# ----
# Create a Model and Translate to Honeybee
toggle = BooleanToggle(True)
detailed_geometry = BooleanToggle(False)
model = DFModel(buildings=flatten(dfdoashvac.df_objs), context=flatten(context.context), name="University Campus")  # -> report, model; plug-in component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

not = GateNot(A=detailed_geometry)

tohoneybee = DFModelToHoneybee(model=model.model, use_multiplier=not, add_plenum=detailed_geometry, ceil_adjacency=detailed_geometry, run=toggle)  # -> report, hb_models; plug-in component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

# ----
# Add Daylight Sensors to Offices
roomenergyattr = HBRoomEnergyAttributes({"Program": "properties.energy.program_type.display_name", "Construction Set": "properties.energy.construction_set.display_name", "Is Conditioned": "properties.energy.is_conditioned", "People per Area [ppl/m2]": "properties.energy.people.people_per_area", "Area per Person [m2/ppl]": "properties.energy.people.area_per_person", "Lighting per Area [W/m2]": "properties.energy.lighting.watts_per_area"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}, selected="Program")
deconstructmodel = HBDeconstructModel(model=tohoneybee.hb_models)  # -> rooms, faces, apertures, doors, shades; plug-in component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
roomsbyattr = HBRoomsByAttribute(rooms=flatten(deconstructmodel.rooms), attribute=roomenergyattr)  # -> values, rooms; plug-in component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
bang = ExplodeTree(Data=roomsbyattr.rooms)  # -> Branch0, Branch1, Branch2, Branch3, Branch4, Branch5
daylightcontrol = HBApplyDaylightControl(rooms=flatten([bang.Branch1, bang.Branch4]))  # -> report, rooms; plug-in component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
data = Data(flatten([bang.Branch0, bang.Branch2, bang.Branch3, bang.Branch5, daylightcontrol.rooms]))
model_2 = HBModel(rooms=flatten(data), shades=flatten(deconstructmodel.shades), name=panel_8)  # -> report, model; plug-in component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

# ----
# Visualize
# Honeybee
# Model
vizbytype = HBVisualizeByType(hb_objs=model_2.model)  # -> walls, interior_walls, roofs, ceilings, exterior_floors, interior_floors, air_walls, apertures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; plug-in component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

setup_runs = SetupRuns(
    _building_type=bldgprograms,
    _climate_zone=importstat.ashrae_zone,
    _ddy=downloadepw.ddy_file,
    _epw=downloadepw.epw_file,
    _model=model_2.model,
    Elec_emissions_=importloc,
    Energy_costs_="--electricity-cost 0.12 --natural-gas-cost 0.09",
    FloorArea_=0,
    Bldg_lighting_="False",
    North_="0",
    Proposed_std_=bldgvintages_3,
    StoryCount_="20",
    Owner="pollination",
    RecipeJsonString="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",
    project="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")
pollinate = Pollinate(_runs=flatten(setup_runs), CPUNumber=26, IfEnabledRemoteRun=False, RunLocal=False, liveUpdateStatus=True)
