# Grasshopper definition clerestory_windows.gh (Grasshopper 1.0.8)

# ----
# Create the base building without roof
floor_geometry = Geometry(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)
room2d = DFRoom2D(geo=flatten(floor_geometry), flr_to_ceiling="7", name="Cape Cod House", conditioned=Toggle(False))  # -> report, room2d; plug-in component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
repeatingratiopar = DFRepeatingWindowRatioParameters(ratio="0.2", horiz_separ="8")  # -> win_par; plug-in component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
story = DFStory(room2ds=flatten(room2d.room2d), name="Cape Cod House")  # -> report, story; plug-in component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
applyfacadepar = DFApplyFacadeParameters(df_obj=story.story, win_par=repeatingratiopar)  # -> report, df_obj; plug-in component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
buildingstories = DFBuildingFromStories(stories=applyfacadepar.df_obj, name="Cape Cod House")  # -> report, building; plug-in component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

# ----
# Add a roof with clearstory windows
topbottom = DFSeparateTopBottom(buildings=flatten(buildingstories.building))  # -> buildings; plug-in component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
clearstory_geometry = Geometry([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])
roof_geometry = Geometry([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])
applyroof = DFApplyRoof(df_obj=topbottom, roof_geo=roof_geometry, clerestory_geo=clearstory_geometry)  # -> df_obj; plug-in component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

# ----
# Apply daylight controls
dfdaylightcontrol = DFApplyDaylightControl(df_objs=flatten(applyroof))  # -> report, df_objs; plug-in component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
model = DFModel(buildings=flatten(dfdaylightcontrol.df_objs), name="Cape Cod House")  # -> report, model; plug-in component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

# ----
# Run an Energy Simulation
panel = Panel("PixelCounting")
panel_2 = Panel("https://energyplus-weather.s3.amazonaws.com/north_and_central_america_wmo_region_4/USA/NY/USA_NY_New.York-J.F.Kennedy.Intl.AP.744860_TMY3/USA_NY_New.York-J.F.Kennedy.Intl.AP.744860_TMY3.zip")
shadowcalc = HBShadowCalculation(calc_method=panel)  # -> shadow_calc; plug-in component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
simpar = HBSimulationParameter(timestep=6, shadow_calc=shadowcalc)  # -> sim_par; plug-in component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
downloadepw = LBDownloadWeather(weather_URL=panel_2)  # -> epw_file, stat_file, ddy_file; plug-in component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

tohoneybee = DFModelToHoneybee(model=model.model, run=Toggle(True))  # -> report, hb_models; plug-in component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
vizbytype = HBVisualizeByType(hb_objs=tohoneybee.hb_models)  # -> walls, interior_walls, roofs, ceilings, exterior_floors, interior_floors, air_walls, apertures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; plug-in component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
toggle = BooleanToggle(False)
modeltoosm = HBModelToOSM(model=tohoneybee.hb_models, epw_file=downloadepw.epw_file, sim_par=simpar, write=toggle, run=toggle)  # -> report, jsons, osw, osm, idf, sql, zsz, rdd, html; plug-in component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

eui = HBEndUseIntensity(sql=modeltoosm.sql)  # -> eui, eui_end_use, end_uses, gross_floor; plug-in component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
panel_3 = Panel(eui.eui_end_use)
panel_4 = Panel(eui.end_uses)
