# Grasshopper definition des_comparison_end.gh (Grasshopper 1.0.8)

# ----
# Construction Set
bldgvintages = HBBuildingVintages({"ASHRAE 90.1 2019  |  IECC 2021": "2019", "ASHRAE 90.1 2016  |  IECC 2018": "2016", "ASHRAE 90.1 2013  |  IECC 2015": "2013", "ASHRAE 90.1 2010  |  IECC 2012": "2010", "ASHRAE 90.1 2007  |  IECC 2009": "2007", "ASHRAE 90.1 2004  |  IECC 2006": "2004", "1980-2004 (CBECS)": "1980_2004", "Pre-1980 (CBECS)": "pre_1980"}, selected="ASHRAE 90.1 2019  |  IECC 2021")
constr_type = Dragonfly_BldgAge({"SteelFramed", "WoodFramed", "Mass", "Metal Building"}, selected="SteelFramed")
climate_zone = Dragonfly_BldgAge({"1 - Very Hot": "1", "2 - Hot": "2", "3 - Warm": "3", "4 - Mixed": "4", "5 - Cool": "5", "6 - Cold": "6", "7 - Very Cold": "7", "8 - Subarctic": "8"}, selected="5 - Cool")
constrsetclimate = HBConstructionSetByClimate(climate_zone=climate_zone, vintage=bldgvintages, constr_type=constr_type)  # -> constr_set; plug-in component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
data = Data(constrsetclimate)

# ----
# Order Programs
# to Match Footprints
bldgprograms = HBBuildingPrograms({"LargeOffice", "MediumOffice", "SmallOffice", "MidriseApartment", "HighriseApartment", "Retail", "StripMall", "PrimarySchool", "SecondarySchool", "SmallHotel", "LargeHotel", "Hospital", "Outpatient", "Laboratory", "Warehouse", "SuperMarket", "FullServiceRestaurant", "QuickServiceRestaurant", "Courthouse", "LargeDataCenterHighITE", "LargeDataCenterLowITE", "SmallDataCenterHighITE", "SmallDataCenterLowITE"}, selected="MidriseApartment")
bldgprograms_2 = HBBuildingPrograms({"LargeOffice", "MediumOffice", "SmallOffice", "MidriseApartment", "HighriseApartment", "Retail", "StripMall", "PrimarySchool", "SecondarySchool", "SmallHotel", "LargeHotel", "Hospital", "Outpatient", "Laboratory", "Warehouse", "SuperMarket", "FullServiceRestaurant", "QuickServiceRestaurant", "Courthouse", "LargeDataCenterHighITE", "LargeDataCenterLowITE", "SmallDataCenterHighITE", "SmallDataCenterLowITE"}, selected="MediumOffice")
merge = Merge(Data1=bldgprograms_2, Data2=bldgprograms_2, Data3=bldgprograms)  # -> simplify(graft(Result))

# ----
# Basic Building Properties
floor_to_floor_m = Panel("3.5")
building_names = Panel("""Office 1
Office 2
Residential 1""")
number_of_stories = Panel("""6
10
3""")
footprints = Geometry(simplify(graft([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])))
perimeter_depth_m = Panel("10")
data_2 = Data(simplify(graft(building_names)))
dup = DuplicateData(Data=floor_to_floor_m, Number=number_of_stories, Order=True)  # -> simplify(Data)

# ----
# Create Buildings
buildingfootprint = DFBuildingFromFootprint(
    footprint_geo=footprints,
    floor_to_floor=dup,
    perim_offset=perimeter_depth_m,
    name=data_2,
    program=merge,
    constr_set=data,
    run=Toggle(True))  # -> report, buildings; plug-in component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
topbottom = DFSeparateTopBottom(buildings=buildingfootprint.buildings)  # -> simplify(buildings); plug-in component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

# ----
# Assign Windows
window_ratios_per_building = Panel("""0.4
0.2
0.2""")
simpleratiopar = DFSimpleWindowRatioParameters(ratio=window_ratios_per_building)  # -> simplify(graft(win_par)); plug-in component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
applyfacadepar = DFApplyFacadeParameters(df_obj=topbottom, win_par=simpleratiopar)  # -> report, df_obj; plug-in component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

# ----
# Assign HVAC System
doas = HBDOASHVACTemplates({"DOAS with fan coil chiller with boiler": "DOAS_FCU_Chiller_Boiler", "DOAS with fan coil chiller with central air source heat pump": "DOAS_FCU_Chiller_ASHP", "DOAS with fan coil chiller with district hot water": "DOAS_FCU_Chiller_DHW", "DOAS with fan coil chiller with baseboard electric": "DOAS_FCU_Chiller_ElectricBaseboard", "DOAS with fan coil chiller with gas unit heaters": "DOAS_FCU_Chiller_GasHeaters", "DOAS with fan coil chiller with no heat": "DOAS_FCU_Chiller", "DOAS with fan coil air-cooled chiller with boiler": "DOAS_FCU_ACChiller_Boiler", "DOAS with fan coil air-cooled chiller with central air source heat pump": "DOAS_FCU_ACChiller_ASHP", "DOAS with fan coil air-cooled chiller with district hot water": "DOAS_FCU_ACChiller_DHW", "DOAS with fan coil air-cooled chiller with baseboard electric": "DOAS_FCU_ACChiller_ElectricBaseboard"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}, selected="DOAS with fan coil district chilled water with district hot water": "DOAS_FCU_DCW_DHW")
dfdoashvac = DFDOASHVAC(df_objs=applyfacadepar.df_obj, system_type=doas, sensible_hr="0.8", latent_hr="0.75", dcv=Toggle(True))  # -> report, df_objs; plug-in component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

# ----
# Assign SHW System
shw = HBSHWTemplates({"Gas Water Heater": "Gas_WaterHeater", "Electric Water Heater": "Electric_WaterHeater", "Heat Pump Water Heater": "HeatPump_WaterHeater", "Gas Tankless Heater": "Gas_TanklessHeater", "Electric Tankless Heater": "Electric_TanklessHeater", "District Water Heater": "District_WaterHeater", "District Tankless Heater": "District_TanklessHeater"}, selected="District Tankless Heater")
shw_2 = DFSHWSystem(df_objs=flatten(dfdoashvac.df_objs), system_type=shw)  # -> report, df_objs; plug-in component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

# ----
# Create Model
panel = Panel("DES_Comparison")
model = DFModel(buildings=flatten(shw_2.df_objs), name=panel)  # -> report, model; plug-in component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

# ----
# Download EPW File
panel_2 = Panel("https://energyplus-weather.s3.amazonaws.com/north_and_central_america_wmo_region_4/USA/NY/USA_NY_Buffalo-Greater.Buffalo.Intl.AP.725280_TMY/USA_NY_Buffalo-Greater.Buffalo.Intl.AP.725280_TMY.zip")
downloadepw = LBDownloadWeather(weather_URL=panel_2)  # -> epw_file, stat_file, ddy_file; plug-in component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

model_2 = Data(model.model)

# ----
# Visualize Model Properties
room2dattr = DFRoom2DAttributes({"Display Name": "display_name", "Simulation Name (Identifier)": "identifier", "Floor-To-Ceiling Height": "floor_to_ceiling_height", "Floor Elevation": "floor_height", "Ceiling Elevation": "ceiling_height", "Is Ground Contact": "is_ground_contact"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}, selected="Program": "properties.energy.program_type.display_name")
colorroom2dattr = DFColorRoom2DAttributes(df_obj=flatten(model_2), attribute=room2dattr)  # -> mesh, legend, wire_frame, values, colors; plug-in component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

# ----
# 1
toggle = BooleanToggle(False)

# ----
# Write geoJSON
panel_3 = Panel("-78.852466")
constrloc = LBConstructLocation(name="Buffalo, NY", latitude="42.813153", longitude=panel_3, time_zone="-5", elevation="200")  # -> location; plug-in component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
pt = Point(Point(0, 0, 0))
togeojson = DFModelToGeoJSON(model=model.model, location=constrloc, point=pt, use_multiplier=Toggle(True), shade_dist="50", write=toggle)  # -> report, geojson, net_json, hb_jsons, hb_models; plug-in component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

# ----
# Simulation Parameters
panel_4 = Panel("FullExterior")
shadowcalc = HBShadowCalculation(solar_dist=panel_4)  # -> shadow_calc; plug-in component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
simpar = HBSimulationParameter(timestep="1", shadow_calc=shadowcalc)  # -> sim_par; plug-in component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

# ----
# 2
toggle_2 = BooleanToggle(False)

# ----
# Run Building
# Load Simulation
runurbanopt = DFRunURBANopt(geojson=togeojson.geojson, epw_file=downloadepw.epw_file, sim_par=simpar, run=toggle_2)  # -> report, scenario, osm, idf, sql, zsz, rdd, html; plug-in component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

# ----
# Create Gen5 GHE District System
panel_5 = Panel("135")
gheborehole = DFGHEBoreholeParameter(min_spacing="3", max_spacing="50", max_depth=panel_5)  # -> borehole; plug-in component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
ghedesign = DFGHEDesignParameter(max_eft="30")  # -> design; plug-in component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
ground_heat_exchanger = Geometry(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)
thermalconnectors = Geometry([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])
gheloop = DFGHEThermalLoop(
    ghe_geo=flatten(ground_heat_exchanger),
    connector_geo=flatten(thermalconnectors),
    clockwise=Toggle(False),
    borehole=gheborehole,
    design=ghedesign,
    name="District GHE Loop")  # -> report, des_loop; plug-in component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

# ----
# Create Gen5 District System
panel_6 = Panel("District Gen5 Loop")
thermalconnectors_2 = Geometry([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])
gen5loop = DFFifthGenerationThermalLoop(
    connector_geo=flatten(thermalconnectors_2),
    clockwise=Toggle(False),
    heat_rejection="CoolingTower",
    supplement_heat="AirSourceHeatPump",
    name=panel_6)  # -> report, des_loop; plug-in component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

# ----
# Create Gen4 District System
panel_7 = Panel("AirSourceHeatPump")
panel_8 = Panel("Integrated")
gen4loop = DFFourthGenerationThermalLoop(heat_recovery_chiller=Toggle(True))  # -> report, des_loop; plug-in component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

# ----
# 3
toggle_3 = BooleanToggle(False)

# ----
# Run District Energy System
path = FilePath(runurbanopt.scenario)
binddesloads = DFBindDESLoadsToModel(model=model_2, scenario=path)  # -> model; plug-in component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
todes = DFModelToDES(model=binddesloads, des_loop=gen4loop.des_loop, epw_file=downloadepw.epw_file, write=toggle_3)  # -> report, geojson, scenario; plug-in component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
exportdes = DFExportDistrictEnergySystem(geojson=todes.geojson, scenario=todes.scenario, write=toggle_3, run=toggle_3)  # -> report, sys_param, osm, idf, sql, rdd, html, modelica; plug-in component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

# ----
# Visualize DES Performance
panel_9 = Panel("Plant Supply Side Inlet Mass Flow Rate")
customresult = HBReadCustomResult(sql=exportdes.sql, output_names=panel_9)  # -> results; plug-in component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
desenergyresult = DFReadDESEnergyResult(sql=exportdes.sql)  # -> cooling, heating, shw, pumps, heat_rejection, supplement_heat; plug-in component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
destemperatureresult = DFReadDESTemperatureResult(sql=exportdes.sql)  # -> chilled_water, hot_water, condenser, ground; plug-in component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
desloadresult = DFReadDESBuildingLoad(sql=exportdes.sql)  # -> cooling, heating, shw; plug-in component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
hourlyplot = LBHourlyPlot(data=flatten([desenergyresult.cooling, desenergyresult.heating]), base_pt="0, -120, 0")  # -> report, mesh, legend, borders, labels, title, vis_set; plug-in component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

# ----
# Compute District EUI for DES
toggle_4 = BooleanToggle(True)
geoprop = DFGeometryProperties(df_objs=flatten(model_2))  # -> height, floor_area, ext_wall_area, ext_win_area, volume; plug-in component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
eui = HBEndUseIntensity(sql=exportdes.sql, abs=toggle_4)  # -> eui, eui_end_use, end_uses, gross_floor; plug-in component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
division = Division(A=eui.eui_end_use, B=geoprop.floor_area)
division_2 = Division(A=eui.eui, B=geoprop.floor_area)
panel_10 = Panel(division)
panel_11 = Panel(division_2)
panel_12 = Panel(eui.end_uses)

# ----
# Visualize GHE
ghesizing = DFReadGHESizing(des_loop=gheloop.des_loop)  # -> report, boreholes, bore_geo, g_function, properties, month_temps; plug-in component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
graph = QuickGraph(ghesizing.month_temps, SortOrder=0)

# ----
# Plant-side EUI without DES
data_3 = Data(["Heating", "Cooling", "Pumps", "Water Systems"])
data_4 = Data([17.159, 12.957, 4.529, 12.599])
ma = MassAddition(Input=data_4)  # -> Result, PartialResults
panel_13 = Panel(data_4)
relavant_for_des = Panel(ma.Result)
panel_14 = Panel(data_3)
