# Grasshopper definition des_modelica_ghe.gh (Grasshopper 1.0.8)

# ----
# Construction Set
bldgvintages = HBBuildingVintages({"ASHRAE 90.1 2019  |  IECC 2021": "2019", "ASHRAE 90.1 2016  |  IECC 2018": "2016", "ASHRAE 90.1 2013  |  IECC 2015": "2013", "ASHRAE 90.1 2010  |  IECC 2012": "2010", "ASHRAE 90.1 2007  |  IECC 2009": "2007", "ASHRAE 90.1 2004  |  IECC 2006": "2004", "1980-2004 (CBECS)": "1980_2004", "Pre-1980 (CBECS)": "pre_1980"}, selected="ASHRAE 90.1 2019  |  IECC 2021")
constr_type = Dragonfly_BldgAge({"SteelFramed", "WoodFramed", "Mass", "Metal Building"}, selected="SteelFramed")
climate_zone = Dragonfly_BldgAge({"1 - Very Hot": "1", "2 - Hot": "2", "3 - Warm": "3", "4 - Mixed": "4", "5 - Cool": "5", "6 - Cold": "6", "7 - Very Cold": "7", "8 - Subarctic": "8"}, selected="5 - Cool")
constrsetclimate = HBConstructionSetByClimate(climate_zone=climate_zone, vintage=bldgvintages, constr_type=constr_type)  # -> constr_set; plug-in component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
data = Data(constrsetclimate)

# ----
# Order Programs
# to Match Footprints
bldgprograms = HBBuildingPrograms({"LargeOffice", "MediumOffice", "SmallOffice", "MidriseApartment", "HighriseApartment", "Retail", "StripMall", "PrimarySchool", "SecondarySchool", "SmallHotel", "LargeHotel", "Hospital", "Outpatient", "Laboratory", "Warehouse", "SuperMarket", "FullServiceRestaurant", "QuickServiceRestaurant", "Courthouse", "LargeDataCenterHighITE", "LargeDataCenterLowITE", "SmallDataCenterHighITE", "SmallDataCenterLowITE"}, selected="MidriseApartment")
merge = Merge(Data1=bldgprograms, Data2=bldgprograms)  # -> simplify(graft(Result))

# ----
# Basic Building Properties
floor_to_floor_m = Panel("3.5")
number_of_stories = Panel("""1
3""")
building_names = Panel("""Residential 1
Residential 2""")
footprints = Geometry(simplify(graft([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])))
perimeter_depth_m = Panel("10")
dup = DuplicateData(Data=floor_to_floor_m, Number=number_of_stories, Order=True)  # -> simplify(Data)
data_2 = Data(simplify(graft(building_names)))

# ----
# Create Buildings
buildingfootprint = DFBuildingFromFootprint(
    footprint_geo=footprints,
    floor_to_floor=dup,
    perim_offset=perimeter_depth_m,
    name=data_2,
    program=merge,
    constr_set=data,
    run=Toggle(True))  # -> report, buildings; plug-in component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
topbottom = DFSeparateTopBottom(buildings=buildingfootprint.buildings)  # -> simplify(buildings); plug-in component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

# ----
# Assign Windows
window_ratios_per_building = Panel("""0.3
0.3""")
simpleratiopar = DFSimpleWindowRatioParameters(ratio=window_ratios_per_building)  # -> simplify(graft(win_par)); plug-in component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
applyfacadepar = DFApplyFacadeParameters(df_obj=topbottom, win_par=simpleratiopar)  # -> report, df_obj; plug-in component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

# ----
# Create GHE
# District System
number_slider = Slider(40, range=5..50)
horizpipe = DFHorizontalPipeParameter()  # -> horiz_pipe; plug-in component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
gheborehole = DFGHEBoreholeParameter(min_spacing=Slider(5, range=0..15), max_spacing=number_slider, max_depth=Slider(120, range=100..400))  # -> borehole; plug-in component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
ghedesign = DFGHEDesignParameter()  # -> design; plug-in component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
ghepipe = DFGHEPipeParameter()  # -> pipe; plug-in component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
ghesoil = DFGHESoilParameter(conductivity="2.0")  # -> soil; plug-in component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
ghefluid = DFGHEFluidParameter()  # -> fluid; plug-in component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
ground_heat_exchanger = Geometry(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)
thermalconnectors = Geometry([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])
gheloop = DFGHEThermalLoop(
    ghe_geo=flatten(ground_heat_exchanger),
    connector_geo=flatten(thermalconnectors),
    clockwise=Toggle(False),
    borehole=gheborehole,
    soil=ghesoil,
    fluid=ghefluid,
    pipe=ghepipe,
    horiz_pipe=horizpipe,
    design=ghedesign,
    name="Redisential GHE Loop")  # -> report, des_loop; plug-in component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
geo = Geometry([Point(288.4994812, -4.074277787, 0), Point(285.5838721, 5.40141068, 0), Point(297.9483922, -1.166907954, 0), Point(295.0327831, 8.308780513, 0), Point(307.3973032, 1.74046188, 0), Point(304.4816941, 11.21615035, 0)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])

# ----
# Assign HVAC
hvac_templates = Panel("""PSZAC_DCW_DHW
PSZAC_DCW_DHW""")
data_3 = Data(simplify(graft(hvac_templates)))
dfallairhvac = DFAllAirHVAC(df_objs=applyfacadepar.df_obj, system_type=data_3)  # -> report, df_objs; plug-in component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

# ----
# Create Model
panel = Panel("Modelica_DES_GHE")
model = DFModel(buildings=flatten(dfallairhvac.df_objs), name=panel)  # -> report, model; plug-in component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

# ---- group: Optionally assign borehole locations
gheloop_2 = DFAssignGHEBoreholes(des_loop=gheloop.des_loop, boreholes=geo)  # -> des_loop, unassigned; plug-in component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

# ----
# Download EPW File
panel_2 = Panel("https://energyplus-weather.s3.amazonaws.com/north_and_central_america_wmo_region_4/USA/NY/USA_NY_Buffalo-Greater.Buffalo.Intl.AP.725280_TMY/USA_NY_Buffalo-Greater.Buffalo.Intl.AP.725280_TMY.zip")
downloadepw = LBDownloadWeather(weather_URL=panel_2)  # -> epw_file, stat_file, ddy_file; plug-in component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

# ----
# Simulation Parameters
toggle = BooleanToggle(True)
simoutput = HBSimulationOutput(zone_energy_use=toggle, system_energy_use=toggle, report_frequency="Monthly")  # -> report, sim_output; plug-in component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
shadowcalc = HBShadowCalculation(solar_dist="FullExterior")  # -> shadow_calc; plug-in component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
simpar = HBSimulationParameter(output=simoutput.sim_output, timestep="1", shadow_calc=shadowcalc)  # -> sim_par; plug-in component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

# ----
# Visualize Model Properties
data_4 = Data(flatten(model.model))
room2dattr = DFRoom2DAttributes({"Display Name": "display_name", "Simulation Name (Identifier)": "identifier", "Floor-To-Ceiling Height": "floor_to_ceiling_height", "Floor Elevation": "floor_height", "Ceiling Elevation": "ceiling_height", "Is Ground Contact": "is_ground_contact"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}, selected="Program": "properties.energy.program_type.display_name")
colorroom2dattr = DFColorRoom2DAttributes(df_obj=flatten(data_4), attribute=room2dattr)  # -> mesh, legend, wire_frame, values, colors; plug-in component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

# ----
# Write geoJSON
panel_3 = Panel("-78.852466")
constrloc = LBConstructLocation(name="Buffalo, NY", latitude="42.813153", longitude=panel_3, time_zone="-5", elevation="200")  # -> location; plug-in component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
pt = Point(Point(0, 0, 0))
togeojson = DFModelToGeoJSON(
    model=model.model,
    location=constrloc,
    point=pt,
    use_multiplier=Toggle(True),
    shade_dist="50",
    des_loop=gheloop.des_loop,
    write=Toggle(False))  # -> report, geojson, net_json, hb_jsons, hb_models; plug-in component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

# ----
# Run Simulation
runurbanopt = DFRunURBANopt(geojson=togeojson.geojson, epw_file=downloadepw.epw_file, sim_par=simpar, run=Toggle(False))  # -> report, scenario, osm, idf, sql, zsz, rdd, html; plug-in component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

# ----
# Export DES
exportdes = DFExportDistrictEnergySystem(geojson=togeojson.geojson, scenario=runurbanopt.scenario, write=Toggle(False))  # -> report, sys_param, osm, idf, sql, rdd, html, modelica; plug-in component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

# ----
# Run Modelica
# Simulation
runmodelica = DFRunModelica(modelica=exportdes.modelica, run=Toggle(False))  # -> report, results; plug-in component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

ghesizing = DFReadGHESizing(sys_param=exportdes.sys_param, des_loop=gheloop.des_loop)  # -> report, boreholes, bore_geo, g_function, properties, month_temps; plug-in component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
panel_4 = Panel(ghesizing.report)
graph = QuickGraph(ghesizing.month_temps, SortOrder=0)
