# Grasshopper definition from_building_footprints.gh (Grasshopper 1.0.7)

# ----
# Construction Set
bldg_vintage = Dragonfly_BldgAge({"ASHRAE 90.1 2013  |  IECC 2015": "2013", "ASHRAE 90.1 2010  |  IECC 2012": "2010", "ASHRAE 90.1 2007  |  IECC 2009": "2007", "ASHRAE 90.1 2004  |  IECC 2006": "2004", "1980-2004 (CBECS)": "1980_2004", "Pre-1980 (CBECS)": "pre_1980"}, selected="Pre-1980 (CBECS)")
climate_zone = Dragonfly_BldgAge({"1 - Very Hot": "1", "2 - Hot": "2", "3 - Warm": "3", "4 - Mixed": "4", "5 - Cool": "5", "6 - Cold": "6", "7 - Very Cold": "7", "8 - Subarctic": "8"}, selected="5 - Cool")
constr_type = Dragonfly_BldgAge({"SteelFramed", "WoodFramed", "Mass", "Metal Building"}, selected="WoodFramed")
searchconstrset = HBSearchConstructionSets(climate_zone=climate_zone, vintage=bldg_vintage, constr_type=constr_type)  # -> constr_set; plug-in component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

# ----
# Full Bldg Small Office ProgramType
panel = Panel("""pre_1980::SmallOffice::ClosedOffice
pre_1980::SmallOffice::Conference
pre_1980::SmallOffice::Corridor
pre_1980::SmallOffice::OpenOffice
pre_1980::SmallOffice::Restroom
pre_1980::SmallOffice::Storage""")
panel_2 = Panel("""0.15
0.15
0.2
0.4
0.05
0.05""")
blendprograms = HBBlendProgramTypes(name="SmallOfficeBuilding", programs=panel, ratios=panel_2)  # -> program; plug-in component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

# ----
# Commercial Buildings from Footprints
commercialfootprints = Geometry([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])
panel_3 = Panel("""4
3
3
3""")
buildingfootprint = DFBuildingFromFootprint(
    footprint_geo=flatten(commercialfootprints),
    floor_to_floor=flatten(panel_3),
    name="CommercialBldg",
    program=blendprograms,
    constr_set=searchconstrset,
    run=Toggle(True))  # -> report, buildings; plug-in component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

# ----
# Residential Buildings from Footprints
panel_4 = Panel("pre_1980::MidriseApartment::Apartment")
residentialfootprints = Geometry([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])
panel_5 = Panel("""3
3
3""")
buildingfootprint_2 = DFBuildingFromFootprint(
    footprint_geo=flatten(residentialfootprints),
    floor_to_floor=flatten(panel_5),
    name="ResidentialBldg",
    program=panel_4,
    constr_set=searchconstrset,
    run=Toggle(True))  # -> report, buildings; plug-in component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
simpleratiopar = DFSimpleWindowRatioParameters(ratio="0.4")  # -> win_par; plug-in component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
simpleratiopar_2 = DFSimpleWindowRatioParameters(ratio="0.25")  # -> win_par; plug-in component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
facparam = HBFacadeParameters(north=simpleratiopar, east=simpleratiopar_2, south=simpleratiopar, west=simpleratiopar_2)  # -> fac_par; plug-in component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
applyfacadepar = DFApplyFacadeParameters(df_obj=flatten(buildingfootprint_2.buildings), win_par=facparam)  # -> report, df_obj; plug-in component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

decnstralldf = DFDeconstructAllObject(df_obj=buildingfootprint.buildings)  # -> all_stories, all_room2ds; plug-in component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
decnstrdf = DFDeconstructObject(df_obj=buildingfootprint.buildings)  # -> stories, room2ds; plug-in component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

# ----
# Facade Parameters
panel_6 = Panel("0.4")
louverpar = DFLouverParameters(depth="0.3", dist_between="0.5", angle="30")  # -> shd_par; plug-in component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
repeatingratiopar = DFRepeatingWindowRatioParameters(ratio=panel_6, glz_height="2.5")  # -> win_par; plug-in component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
singlewindowpar = DFSingleWindowParameters(width="+inf", height="1")  # -> win_par; plug-in component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
overhangpar = DFOverhangParameters(depth="3", angle="-10")  # -> shd_par; plug-in component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
borderpar = DFExtrudedBorderParameters(depth="0.3")  # -> shd_par; plug-in component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

# ----
# Properties for Office Floors
panel_7 = Panel("1")
item = ListItem(List=decnstrdf.stories, Index=panel_7, Wrap=True)
simpleratiopar_3 = DFSimpleWindowRatioParameters(ratio="0.25")  # -> win_par; plug-in component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
applyfacadepar_2 = DFApplyFacadeParameters(df_obj=item, win_par=simpleratiopar_3)  # -> report, df_obj; plug-in component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

# ----
# Properties for Retail Floors
panel_8 = Panel("pre_1980::StripMall::Type 1")
item_2 = ListItem(List=decnstrdf.stories, Index="0", Wrap=True)
reassignprop = DFReassignEnergyProperties(df_obj=item_2, program=panel_8)  # -> df_obj; plug-in component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
simpleratiopar_4 = DFSimpleWindowRatioParameters(ratio="0.4")  # -> win_par; plug-in component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
applyfacadepar_3 = DFApplyFacadeParameters(df_obj=reassignprop, win_par=simpleratiopar_4)  # -> report, df_obj; plug-in component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

txt = Text(buildingfootprint.buildings)
split = TextSplit(Text=txt, Separators=":")
item_3 = ListItem(List=split, Index="-1", Wrap=True)  # -> simplify(Item)

all_commercial_stories = Data(simplify([applyfacadepar_3.df_obj, applyfacadepar_2.df_obj]))
buildingstories = DFBuildingFromStories(stories=all_commercial_stories, name=item_3, constr_set=searchconstrset)  # -> report, building; plug-in component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
all_buildings = Data(flatten([buildingstories.building, applyfacadepar.df_obj]))

toggle = BooleanToggle(True)
model = DFModel(buildings=flatten(all_buildings), name="New Urbanist District", run=toggle)  # -> report, model; plug-in component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
tohoneybee = DFModelToHoneybee(model=model.model, use_multiplier=Toggle(False), shade_dist="25", run=toggle)  # -> report, hb_models; plug-in component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

# ----
# Visualize Model
number_slider = Slider(6, range=0..10)
item_4 = ListItem(List=tohoneybee.hb_models, Index=number_slider, Wrap=True)
vizall = HBVizualizeAll(hb_obj=flatten(item_4))  # -> geo; plug-in component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

# ----
# Download EPW File
panel_9 = Panel("https://www.energyplus.net/weather-download/north_and_central_america_wmo_region_4/USA/MA/USA_MA_Boston-Logan.Intl.AP.725090_TMY3/all")
downloadweather = LadybugPlus_DownloadWeather(weather_URL=panel_9)  # -> epw_file, stat_file, ddy_file; plug-in component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

# ----
# Simulation Parameters
toggle_2 = BooleanToggle(True)
simoutput = HBSimulationOutput(zone_energy_use=toggle_2, summary_reports="AllSummary")  # -> report, sim_output; plug-in component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
shadowcalc = HBShadowCalculation(solar_dist="FullExteriorWithReflections")  # -> shadow_calc; plug-in component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
simpar = HBSimulationParameter(output=simoutput.sim_output, timestep=6, shadow_calc=shadowcalc)  # -> sim_par; plug-in component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

panel_10 = Panel("C:\Users\chris\Documents\GitHub\dragonfly-grasshopper\dragonfly_grasshopper")
createuo = LBCreateUserObject(folder=panel_10, change_type="perf", export=Toggle(False))  # -> read_me; plug-in component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

modeltoidf = HBModelToIDF(
    model=tohoneybee.hb_models,
    epw_file=downloadweather.epw_file,
    sim_par=simpar,
    folder="C:\Users\chris\honeybee\district_model",
    write=Toggle(False))  # -> report, idf, sql, eio, rdd, html; plug-in component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

# ----
# Optional Run In Parallel
toggle_3 = BooleanToggle(False)  # disabled
toggle_4 = BooleanToggle(False)  # disabled
re_run_idf = Honeybee_ReRunIDF(idfFilePath=modeltoidf.idf, epwFileAddress=downloadweather.epw_file, parallel=toggle_4, runIt=toggle_3)  # -> report, resultFileAddress, eioFileAddress, rddFileAddress; disabled; plug-in component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
honeybee = Honeybee_Honeybee()  # -> Vviiiiiiiiiizzz; disabled; plug-in component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
