# Grasshopper definition from_building_solids.gh (Grasshopper 1.0.7)

# ----
# Full Bldg Small Office ProgramType
panel = Panel("""2013::LargeOffice::ClosedOffice
2013::LargeOffice::Conference
2013::LargeOffice::Corridor
2013::LargeOffice::OpenOffice
2013::LargeOffice::Restroom
2013::LargeOffice::Storage""")
panel_2 = Panel("""0.15
0.15
0.2
0.4
0.05
0.05""")
blendprograms = HBBlendProgramTypes(name="LargeOfficeBuilding", programs=panel, ratios=panel_2)  # -> program; plug-in component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

# ----
# Construction Set
bldg_vintage = Dragonfly_BldgAge({"ASHRAE 90.1 2013  |  IECC 2015": "2013", "ASHRAE 90.1 2010  |  IECC 2012": "2010", "ASHRAE 90.1 2007  |  IECC 2009": "2007", "ASHRAE 90.1 2004  |  IECC 2006": "2004", "1980-2004 (CBECS)": "1980_2004", "Pre-1980 (CBECS)": "pre_1980"}, selected="ASHRAE 90.1 2013  |  IECC 2015")
constr_type = Dragonfly_BldgAge({"SteelFramed", "WoodFramed", "Mass", "Metal Building"}, selected="SteelFramed")
climate_zone = Dragonfly_BldgAge({"1 - Very Hot": "1", "2 - Hot": "2", "3 - Warm": "3", "4 - Mixed": "4", "5 - Cool": "5", "6 - Cold": "6", "7 - Very Cold": "7", "8 - Subarctic": "8"}, selected="5 - Cool")
constrsetclimate = HBConstructionSetByClimate(climate_zone=climate_zone, vintage=bldg_vintage, constr_type=constr_type)  # -> constr_set; plug-in component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

# ----
# Create Office Buildings
panel_3 = Panel("OfficeBldg")
officesolids = Geometry([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])
panel_4 = Panel("""1@5
2@4
@3""")
buildingsolid = DFBuildingFromSolid(
    bldg_geo=flatten(officesolids),
    floor_to_floor=panel_4,
    name=panel_3,
    program=blendprograms,
    constr_set=constrsetclimate,
    run=Toggle(True))  # -> report, buildings; plug-in component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
decnstrdf = DFDeconstructObject(df_obj=buildingsolid.buildings)  # -> stories, room2ds; plug-in component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

# ----
# Create Residential Buildings
panel_5 = Panel("2013::MidriseApartment::Apartment")
residentialsolids = Geometry([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])
buildingsolid_2 = DFBuildingFromSolid(
    bldg_geo=flatten(residentialsolids),
    floor_to_floor="@4",
    name="ResidentialBldg",
    program=panel_5,
    constr_set=constrsetclimate,
    run=Toggle(True))  # -> report, buildings; plug-in component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
simpleratiopar = DFSimpleWindowRatioParameters(ratio="0.25")  # -> win_par; plug-in component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
applyfacadepar = DFApplyFacadeParameters(df_obj=flatten(buildingsolid_2.buildings), win_par=simpleratiopar)  # -> report, df_obj; plug-in component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

# ---- group: properties for ground floor retail
item = ListItem(List=decnstrdf.stories, Index="0", Wrap=True)
reassignprop = DFReassignEnergyProperties(df_obj=item, program="2013::Retail::Retail")  # -> df_obj; plug-in component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
overhangpar = DFOverhangParameters(depth="4", angle="10")  # -> shd_par; plug-in component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
simpleratiopar_2 = DFSimpleWindowRatioParameters(ratio="0.65")  # -> win_par; plug-in component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
applyfacadepar_2 = DFApplyFacadeParameters(df_obj=reassignprop, win_par=simpleratiopar_2, shd_par=overhangpar)  # -> report, df_obj; plug-in component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

# ---- group: properties for above-ground office
cull_i = CullIndex(List=decnstrdf.stories, Indices="0", Wrap=True)
simpleratiopar_3 = DFSimpleWindowRatioParameters(ratio="0.4")  # -> win_par; plug-in component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
applyfacadepar_3 = DFApplyFacadeParameters(df_obj=cull_i, win_par=simpleratiopar_3)  # -> report, df_obj; plug-in component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

# ----
txt = Text(buildingsolid.buildings)
split = TextSplit(Text=txt, Separators=":")
item_2 = ListItem(List=split, Index="-1", Wrap=True)  # -> simplify(Item)

stories = Data(simplify(applyfacadepar_3.df_obj))
stories_2 = Data(simplify(applyfacadepar_2.df_obj))
stories_3 = Data(simplify([stories, stories_2]))
buildingstories = DFBuildingFromStories(stories=stories_3, name=item_2, constr_set=constrsetclimate)  # -> report, building; plug-in component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
commercialbldgs = Data(flatten(buildingstories.building))
all_buildings = Data(flatten([commercialbldgs, applyfacadepar.df_obj]))

# ----
# Create Dragonfly  Model
panel_6 = Panel("ParkingStructure")
contextshade = Geometry([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])
context = DFContextShade(geo=contextshade, name=panel_6)  # -> report, context; plug-in component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
model = DFModel(buildings=flatten(all_buildings), context=flatten(context.context), name="Mass Pike District")  # -> report, model; plug-in component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

roomenergyattr = HBRoomEnergyAttributes({"Program": "properties.energy.program_type.display_name", "Construction Set": "properties.energy.construction_set.display_name", "Is Conditioned": "properties.energy.is_conditioned", "People per Area [ppl/m2]": "properties.energy.people.people_per_area", "Area per Person [m2/ppl]": "properties.energy.people.area_per_person", "Lighting per Area [W/m2]": "properties.energy.lighting.watts_per_area", "Electric Equipment per Area [W/m2]": "properties.energy.electric_equipment.watts_per_area", "Gas Equipment per Area [W/m2]": "properties.energy.gas_equipment.watts_per_area", "Hot Water per Area [L/h-m2]": "properties.energy.service_hot_water.flow_per_area", "Infiltration per Exterior Area [m3/s-m2]": "properties.energy.infiltration.flow_per_exterior_area"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}, selected="Program")
colorroom2dattr = DFColorRoom2DAttributes(df_obj=flatten(model.model), attribute=roomenergyattr)  # -> mesh, legend, wire_frame, values, colors; plug-in component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

# ----
# Option 2: Run Models with OpenStudio
dragonfly_model = Data(model.model)

# ----
# Download EPW File
panel_7 = Panel("https://www.energyplus.net/weather-download/north_and_central_america_wmo_region_4/USA/MA/USA_MA_Boston-Logan.Intl.AP.725090_TMY3/all")
downloadepw = LBDownloadWeather(weather_URL=panel_7)  # -> epw_file, stat_file, ddy_file; plug-in component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

# ----
# Simulation Parameters
toggle = BooleanToggle(True)
simoutput = HBSimulationOutput(zone_energy_use=toggle, report_frequency="Monthly")  # -> report, sim_output; plug-in component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
simpar = HBSimulationParameter(output=simoutput.sim_output, timestep="1")  # -> sim_par; plug-in component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

# ----
# Translate to Honeybee
# 1
# Translate Models
# to Honeybee
toggle_2 = BooleanToggle(False)
tohoneybee = DFModelToHoneybee(model=dragonfly_model, use_multiplier=Toggle(False), shade_dist="25", run=toggle_2)  # -> report, hb_models; plug-in component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

# ----
# Export to OpenStudio
# 2
# Export
# OSW Files
toggle_3 = BooleanToggle(False)
modeltoosm = HBModelToOSM(model=tohoneybee.hb_models, epw_file=downloadepw.epw_file, sim_par=simpar, write=toggle_3)  # -> report, jsons, osw, osm, idf, sql, zsz, rdd, html; plug-in component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

# ----
# Run Simulations
# 3
# Run OSWs
# and Simulation
# in Parallel
toggle_4 = BooleanToggle(False)
runosw = HBRunOSW(osw=modeltoosm.osw, epw_file=downloadepw.epw_file, parallel=Toggle(True), translate=toggle_4, run=toggle_4)  # -> report, osm, idf, sql, zsz, rdd, html; plug-in component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

# ----
# Option 1: Run Models with URBANopt
# Requires installation of URBANopt SDK
dragonfly_model_2 = Data(model.model)

# ----
# Create URBANopt geoJSON
panel_8 = Panel("Hancock Tower")
constrloc = LBConstructLocation(name=panel_8, latitude="42.348819", longitude="-71.075378", time_zone="-5", elevation=0)  # -> location; plug-in component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
directory_into_which_files_will_be_writt = Panel("C:\test_district")  # "Directory into which files will be written"
# 1
# Create
# URBANopt
# geoJSON
toggle_5 = BooleanToggle(False)
pt = Point(Point(-137.6142869, 114.6855446, 0))
togeojson = DFModelToGeoJSON(
    model=dragonfly_model_2,
    location=constrloc,
    point=pt,
    use_multiplier=Toggle(False),
    shade_dist="50",
    folder=directory_into_which_files_will_be_writt,
    write=toggle_5)  # -> report, geojson, hb_jsons, hb_models; plug-in component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

# ----
# Visualize
# Honeybee
# Models
number_slider = Slider(7, range=0..29)
item_3 = ListItem(List=togeojson.hb_models, Index=number_slider, Wrap=True)
vizbytype = HBVisualizeByType(hb_objs=item_3)  # -> walls, interior_walls, roofs, ceilings, exterior_floors, interior_floors, air_walls, apertures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; plug-in component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

# ----
# Run URBANopt
# 2
# Execute Simulations
# With URBANopt
toggle_6 = BooleanToggle(False)
runurbanopt = DFRunURBANopt(geojson=togeojson.geojson, epw_file=downloadepw.epw_file, sim_par=simpar, report=Toggle(True), cpus="10", run=toggle_6)  # -> report, scenario, osm, idf, sql, zsz, rdd, html; plug-in component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

data = Data(togeojson.hb_models)

# ----
# Color Rooms With Results
roomenergyresult = HBReadRoomEnergyResult(sql=runurbanopt.sql)  # -> cooling, heating, lighting, electric_equip, gas_equip, hot_water, fan_electric, pump_electric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; plug-in component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
colorrooms = HBColorRooms(data=flatten(roomenergyresult.heating), rooms_model=flatten(data), norm_by_flr=Toggle(True))  # -> report, mesh, wire_frame, legend, title, rooms, colors, values; plug-in component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

# ----
# Run REopt Lite Cost Optimization
panel_9 = Panel("30")
financialpar = LBREoptFinancialParameters(years=panel_9)  # -> financial_par; plug-in component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
runreopt = DFRunREopt(
    geojson=togeojson.geojson,
    scenario=runurbanopt.scenario,
    urdb_label="5cd34ccf5457a38e7454e9d3",
    financial_par=financialpar,
    run=Toggle(False))  # -> report, csv, json; plug-in component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
