# Grasshopper definition load_sharing_example.gh (Grasshopper 1.0.8)

# ----
# Create Blended Building Programs
panel = Panel("""2013::Retail::Retail
2013::SmallOffice::ClosedOffice
2013::SmallOffice::Conference
2013::SmallOffice::Corridor
2013::SmallOffice::OpenOffice""")
panel_2 = Panel("""0.4
0.1
0.05
0.2
0.25""")
bldgprograms = HBBuildingPrograms({"LargeOffice", "MediumOffice", "SmallOffice", "MidriseApartment", "HighriseApartment", "Retail", "StripMall", "PrimarySchool", "SecondarySchool", "SmallHotel", "LargeHotel", "Hospital", "Outpatient", "Laboratory", "Warehouse", "SuperMarket", "FullServiceRestaurant", "QuickServiceRestaurant", "Courthouse", "LargeDataCenterHighITE", "LargeDataCenterLowITE", "SmallDataCenterHighITE", "SmallDataCenterLowITE"}, selected="Outpatient")
bldgprograms_2 = HBBuildingPrograms({"LargeOffice", "MediumOffice", "SmallOffice", "MidriseApartment", "HighriseApartment", "Retail", "StripMall", "PrimarySchool", "SecondarySchool", "SmallHotel", "LargeHotel", "Hospital", "Outpatient", "Laboratory", "Warehouse", "SuperMarket", "FullServiceRestaurant", "QuickServiceRestaurant", "Courthouse", "LargeDataCenterHighITE", "LargeDataCenterLowITE", "SmallDataCenterHighITE", "SmallDataCenterLowITE"}, selected="FullServiceRestaurant")
bldgprograms_3 = HBBuildingPrograms({"LargeOffice", "MediumOffice", "SmallOffice", "MidriseApartment", "HighriseApartment", "Retail", "StripMall", "PrimarySchool", "SecondarySchool", "SmallHotel", "LargeHotel", "Hospital", "Outpatient", "Laboratory", "Warehouse", "SuperMarket", "FullServiceRestaurant", "QuickServiceRestaurant", "Courthouse", "LargeDataCenterHighITE", "LargeDataCenterLowITE", "SmallDataCenterHighITE", "SmallDataCenterLowITE"}, selected="MidriseApartment")
bldgprograms_4 = HBBuildingPrograms({"LargeOffice", "MediumOffice", "SmallOffice", "MidriseApartment", "HighriseApartment", "Retail", "StripMall", "PrimarySchool", "SecondarySchool", "SmallHotel", "LargeHotel", "Hospital", "Outpatient", "Laboratory", "Warehouse", "SuperMarket", "FullServiceRestaurant", "QuickServiceRestaurant", "Courthouse", "LargeDataCenterHighITE", "LargeDataCenterLowITE", "SmallDataCenterHighITE", "SmallDataCenterLowITE"}, selected="StripMall")
bldgprograms_5 = HBBuildingPrograms({"LargeOffice", "MediumOffice", "SmallOffice", "MidriseApartment", "HighriseApartment", "Retail", "StripMall", "PrimarySchool", "SecondarySchool", "SmallHotel", "LargeHotel", "Hospital", "Outpatient", "Laboratory", "Warehouse", "SuperMarket", "FullServiceRestaurant", "QuickServiceRestaurant", "Courthouse", "LargeDataCenterHighITE", "LargeDataCenterLowITE", "SmallDataCenterHighITE", "SmallDataCenterLowITE"}, selected="MediumOffice")
blendprograms = HBBlendProgramTypes(name="Mixed Use Building Program", programs=panel, ratios=panel_2)  # -> program; plug-in component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

# ----
# Construction Set
bldg_vintage = Dragonfly_BldgAge({"ASHRAE 90.1 2013  |  IECC 2015": "2013", "ASHRAE 90.1 2010  |  IECC 2012": "2010", "ASHRAE 90.1 2007  |  IECC 2009": "2007", "ASHRAE 90.1 2004  |  IECC 2006": "2004", "1980-2004 (CBECS)": "1980_2004", "Pre-1980 (CBECS)": "pre_1980"}, selected="ASHRAE 90.1 2013  |  IECC 2015")
constr_type = Dragonfly_BldgAge({"SteelFramed", "WoodFramed", "Mass", "Metal Building"}, selected="SteelFramed")
climate_zone = Dragonfly_BldgAge({"1 - Very Hot": "1", "2 - Hot": "2", "3 - Warm": "3", "4 - Mixed": "4", "5 - Cool": "5", "6 - Cold": "6", "7 - Very Cold": "7", "8 - Subarctic": "8"}, selected="5 - Cool")
constrsetclimate = HBConstructionSetByClimate(climate_zone=climate_zone, vintage=bldg_vintage, constr_type=constr_type)  # -> constr_set; plug-in component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
data = Data(constrsetclimate)

# ----
# Basic Building Properties
building_names = Panel("""Mixed_use 1
Restaurant 1
Residential 1
Residential 2
Residential 4
Residential 5
Office 1
Hospital 1
Hospital 2
Mixed use 2
Residential 3
Mall 1
Residential 6""")
floor_to_floor_m = Panel("3.5")
number_of_stories = Panel("""4
1
3
3
1
1
6
10
3
8
3
3
10""")
footprints = Geometry(simplify(graft([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])))
perimeter_depth_m = Panel("10")
dup = DuplicateData(Data=floor_to_floor_m, Number=number_of_stories, Order=True)  # -> simplify(Data)
data_2 = Data(simplify(graft(building_names)))

# ----
# Order Programs
# to Match Footprints
merge = Merge(
    Data1=blendprograms,
    Data2=bldgprograms_2,
    Data3=bldgprograms_3,
    Data4=bldgprograms_3,
    Data5=bldgprograms_3,
    Data6=bldgprograms_3,
    Data7=bldgprograms_5,
    Data8=bldgprograms,
    Data9=bldgprograms,
    Data10=blendprograms,
    Data11=bldgprograms_3,
    Data12=bldgprograms_4,
    Data13=bldgprograms_3)  # -> simplify(graft(Result))

# ----
# Create Buildings
buildingfootprint = DFBuildingFromFootprint(
    footprint_geo=footprints,
    floor_to_floor=dup,
    perim_offset=perimeter_depth_m,
    name=data_2,
    program=merge,
    constr_set=data,
    run=Toggle(True))  # -> report, buildings; plug-in component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
topbottom = DFSeparateTopBottom(buildings=buildingfootprint.buildings)  # -> simplify(buildings); plug-in component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

# ----
# Assign Windows
window_ratios_per_building = Panel("""0.2
0.35
0.3
0.3
0.3
0.3
0.7
0.6
0.6
0.35
0.3
0.25
0.4""")
simpleratiopar = DFSimpleWindowRatioParameters(ratio=window_ratios_per_building)  # -> simplify(graft(win_par)); plug-in component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
applyfacadepar = DFApplyFacadeParameters(df_obj=topbottom, win_par=simpleratiopar)  # -> report, df_obj; plug-in component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

# ----
# Assign HVAC System
doas = HBDOASHVACTemplates({"DOAS with fan coil chiller with boiler": "DOAS_FCU_Chiller_Boiler", "DOAS with fan coil chiller with central air source heat pump": "DOAS_FCU_Chiller_ASHP", "DOAS with fan coil chiller with district hot water": "DOAS_FCU_Chiller_DHW", "DOAS with fan coil chiller with baseboard electric": "DOAS_FCU_Chiller_ElectricBaseboard", "DOAS with fan coil chiller with gas unit heaters": "DOAS_FCU_Chiller_GasHeaters", "DOAS with fan coil chiller with no heat": "DOAS_FCU_Chiller", "DOAS with fan coil air-cooled chiller with boiler": "DOAS_FCU_ACChiller_Boiler", "DOAS with fan coil air-cooled chiller with central air source heat pump": "DOAS_FCU_ACChiller_ASHP", "DOAS with fan coil air-cooled chiller with district hot water": "DOAS_FCU_ACChiller_DHW", "DOAS with fan coil air-cooled chiller with baseboard electric": "DOAS_FCU_ACChiller_ElectricBaseboard"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}, selected="DOAS with fan coil district chilled water with district hot water": "DOAS_FCU_DCW_DHW")
dfdoashvac = DFDOASHVAC(df_objs=applyfacadepar.df_obj, system_type=doas, sensible_hr="0.8", latent_hr="0.75", dcv=Toggle(True))  # -> report, df_objs; plug-in component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

# ----
# Assign SHW System
shw = HBSHWTemplates({"Gas Water Heater": "Gas_WaterHeater", "Electric Water Heater": "Electric_WaterHeater", "Heat Pump Water Heater": "HeatPump_WaterHeater", "Gas Tankless Heater": "Gas_TanklessHeater", "Electric Tankless Heater": "Electric_TanklessHeater", "District Water Heater": "District_WaterHeater", "District Tankless Heater": "District_TanklessHeater"}, selected="District Tankless Heater")
shw_2 = DFSHWSystem(df_objs=flatten(dfdoashvac.df_objs), system_type=shw)  # -> report, df_objs; plug-in component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

# ----
# Create Dragonfly Model
panel_3 = Panel("Buffalo New Development")
model = DFModel(buildings=flatten(shw_2.df_objs), name=panel_3)  # -> report, model; plug-in component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

# ----
# Simulation Parameters
panel_4 = Panel("""Zone Ideal Loads Supply Air Total Cooling Energy
Zone Ideal Loads Supply Air Total Heating Energy
Water Use Equipment Heating Energy""")
customoutput = HBCustomSimulationOutput(output_names=panel_4)  # -> report, sim_output; plug-in component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
simpar = HBSimulationParameter(output=customoutput.sim_output, timestep=6)  # -> sim_par; plug-in component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

# ----
# Visualize Model Properties
room2dattr = DFRoom2DAttributes({"Display Name": "display_name", "Simulation Name (Identifier)": "identifier", "Floor-To-Ceiling Height": "floor_to_ceiling_height", "Floor Elevation": "floor_height", "Ceiling Elevation": "ceiling_height", "Is Ground Contact": "is_ground_contact"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}, selected="Program": "properties.energy.program_type.display_name")
data_3 = Data(flatten(model.model))
colorroom2dattr = DFColorRoom2DAttributes(df_obj=flatten(data_3), attribute=room2dattr)  # -> mesh, legend, wire_frame, values, colors; plug-in component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

# ----
# Download EPW File
panel_5 = Panel("https://energyplus-weather.s3.amazonaws.com/north_and_central_america_wmo_region_4/USA/NY/USA_NY_Buffalo-Greater.Buffalo.Intl.AP.725280_TMY/USA_NY_Buffalo-Greater.Buffalo.Intl.AP.725280_TMY.zip")
downloadepw = LBDownloadWeather(weather_URL=panel_5)  # -> epw_file, stat_file, ddy_file; plug-in component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

# ----
# Write geoJSON
panel_6 = Panel("-78.852466")
constrloc = LBConstructLocation(name="Buffalo, NY", latitude="42.813153", longitude=panel_6, time_zone="-5", elevation="200")  # -> location; plug-in component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
pt = Point(Point(0, 0, 0))
togeojson = DFModelToGeoJSON(
    model=model.model,
    location=constrloc,
    point=pt,
    use_multiplier=Toggle(False),
    ceil_adjacency=Toggle(True),
    shade_dist="50",
    write=Toggle(False))  # -> report, geojson, net_json, hb_jsons, hb_models; plug-in component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

# ----
# Run Simulation
runurbanopt = DFRunURBANopt(geojson=togeojson.geojson, epw_file=downloadepw.epw_file, sim_par=simpar, run=Toggle(False))  # -> report, scenario, osm, idf, sql, zsz, rdd, html; plug-in component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

desloadresult = DFReadDESBuildingLoad(sql=runurbanopt.sql)  # -> cooling, heating, shw; plug-in component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

# ----
# Cooling Load
panel_7 = Panel("District Heating Demand")
massarithop = LBMassArithmeticOperation(data=flatten(desloadresult.heating), type=panel_7)  # -> data; plug-in component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
colrange = LBColorRange(index="16")  # -> colors; plug-in component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
legendpar = LBLegendParameters(min="0", max="3000", colors=colrange, num_decimals="0")  # -> leg_par; plug-in component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
hourlyplot = LBHourlyPlot(data=massarithop, base_pt="0,-350,0", legend_par=legendpar)  # -> report, mesh, legend, borders, labels, title, vis_set; plug-in component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
item = ListItem(List=hourlyplot.legend, Index=0, Wrap=True)
medges = MeshEdges(Mesh=item)  # -> NakedEdges, InteriorEdges, NonManifoldEdges

# ----
# Heating Load
panel_8 = Panel("District Cooling Demand")
massarithop_2 = LBMassArithmeticOperation(data=flatten(desloadresult.cooling), type=panel_8)  # -> data; plug-in component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
colrange_2 = LBColorRange(index="17")  # -> colors; plug-in component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
legendpar_2 = LBLegendParameters(min="0", max="3000", colors=colrange_2, num_decimals="0")  # -> leg_par; plug-in component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
hourlyplot_2 = LBHourlyPlot(data=massarithop_2, base_pt="0,-200,0", legend_par=legendpar_2)  # -> report, mesh, legend, borders, labels, title, vis_set; plug-in component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
item_2 = ListItem(List=hourlyplot_2.legend, Index=0, Wrap=True)
medges_2 = MeshEdges(Mesh=item_2)  # -> NakedEdges, InteriorEdges, NonManifoldEdges

# ----
# Overlap Load
python = GhPythonScript(cooling=massarithop_2, heating=massarithop)  # -> overlap
# ---------- python: Python ----------
from ladybug.datatype.energy import Energy
from ladybug.header import Header
from ladybug.datacollection import HourlyContinuousCollection


if _cooling and _heating:
    overlap_vals = []
    for cool, heat in zip(_cooling.values, _heating.values):
        if cool < heat:
            overlap_vals.append(cool)
        else:
            overlap_vals.append(heat)
    head = Header(Energy(), 'kWh', _cooling.header.analysis_period,
                  {'type': 'Distric Thermal Overlap'})
    overlap = HourlyContinuousCollection(head, overlap_vals)
# ---------- end python ----------
legendpar_3 = LBLegendParameters(
    min="0",
    max="3000",
    colors=[ColourSwatch(SwatchColor=RGB(255, 255, 255)), ColourSwatch(SwatchColor=RGB(0, 217, 25)), ColourSwatch(SwatchColor=RGB(12, 145, 0))],
    num_decimals="0")  # -> leg_par; plug-in component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
hourlyplot_3 = LBHourlyPlot(data=python, base_pt="0,-500,0", legend_par=legendpar_3)  # -> report, mesh, legend, borders, labels, title, vis_set; plug-in component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
item_3 = ListItem(List=hourlyplot_3.legend, Index=0, Wrap=True)
medges_3 = MeshEdges(Mesh=item_3)  # -> NakedEdges, InteriorEdges, NonManifoldEdges
