# Grasshopper definition mapper_measure_example.gh (Grasshopper 1.0.7)

# ----
# Create Blended Building Programs
panel = Panel("""2013::Hospital::Corridor
2013::Hospital::Dining
2013::Hospital::Lobby
2013::Hospital::NurseStn
2013::Hospital::Office
2013::Hospital::PatRoom""")
panel_2 = Panel("""2013::FullServiceRestaurant::Dining
2013::FullServiceRestaurant::Kitchen""")
panel_3 = Panel("""2013::StripMall::Type 2
2013::FullServiceRestaurant::Dining
2013::FullServiceRestaurant::Kitchen
2013::SmallHotel::Corridor
2013::SmallHotel::GuestLounge
2013::SmallHotel::GuestRoom
2013::SmallHotel::Office""")
panel_4 = Panel("""2013::SmallOffice::ClosedOffice
2013::SmallOffice::Conference
2013::SmallOffice::Corridor
2013::SmallOffice::OpenOffice
2013::SmallOffice::Restroom
2013::SmallOffice::Storage""")
panel_5 = Panel("""2013::MidriseApartment::Apartment
2013::MidriseApartment::Corridor
2013::MidriseApartment::Office""")
panel_6 = Panel("""0.15
0.15
0.2
0.4
0.05
0.05""")
panel_7 = Panel("""0.6
0.35
0.05""")
panel_8 = Panel("""0.3
0.1
0.1
0.05
0.05
0.4""")
panel_9 = Panel("""0.8
0.2""")
panel_10 = Panel("""0.3
0.25
0.05
0.1
0.05
0.2
0.05""")
blendprograms = HBBlendProgramTypes(name="Residential Building", programs=panel_5, ratios=panel_7)  # -> program; plug-in component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
blendprograms_2 = HBBlendProgramTypes(name="Office Building", programs=panel_4, ratios=panel_6)  # -> program; plug-in component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
blendprograms_3 = HBBlendProgramTypes(name="Mixed Use Building", programs=panel_3, ratios=panel_10)  # -> program; plug-in component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
blendprograms_4 = HBBlendProgramTypes(name="Restaurant Building", programs=panel_2, ratios=panel_9)  # -> program; plug-in component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
blendprograms_5 = HBBlendProgramTypes(name="Hospital Building", programs=panel, ratios=panel_8)  # -> program; plug-in component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

# ----
# Basic Building Properties
building_names = Panel("""Mixed_use 1
Restaurant 1
Residential 1
Residential 2
Residential 4
Residential 5
Office 1
Hospital 1
Hospital 2
Mixed use 2
Residential 3
Mall 1
Residential 6""")
floor_to_floor_m = Panel("3.5")
number_of_stories = Panel("""4
1
3
3
1
1
6
10
3
8
3
3
10""")
footprints = Geometry(simplify(graft([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])))
perimeter_depth_m = Panel("10")
dup = DuplicateData(Data=floor_to_floor_m, Number=number_of_stories, Order=True)  # -> simplify(Data)
data = Data(simplify(graft(building_names)))

# ----
# Construction Set
bldg_vintage = Dragonfly_BldgAge({"ASHRAE 90.1 2013  |  IECC 2015": "2013", "ASHRAE 90.1 2010  |  IECC 2012": "2010", "ASHRAE 90.1 2007  |  IECC 2009": "2007", "ASHRAE 90.1 2004  |  IECC 2006": "2004", "1980-2004 (CBECS)": "1980_2004", "Pre-1980 (CBECS)": "pre_1980"}, selected="ASHRAE 90.1 2013  |  IECC 2015")
constr_type = Dragonfly_BldgAge({"SteelFramed", "WoodFramed", "Mass", "Metal Building"}, selected="SteelFramed")
climate_zone = Dragonfly_BldgAge({"1 - Very Hot": "1", "2 - Hot": "2", "3 - Warm": "3", "4 - Mixed": "4", "5 - Cool": "5", "6 - Cold": "6", "7 - Very Cold": "7", "8 - Subarctic": "8"}, selected="5 - Cool")
constrsetclimate = HBConstructionSetByClimate(climate_zone=climate_zone, vintage=bldg_vintage, constr_type=constr_type)  # -> constr_set; plug-in component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
data_2 = Data(constrsetclimate)

# ----
# Order Programs
# to Match Footprints
merge = Merge(
    Data1=blendprograms_3,
    Data2=blendprograms_4,
    Data3=blendprograms,
    Data4=blendprograms,
    Data5=blendprograms,
    Data6=blendprograms,
    Data7=blendprograms_2,
    Data8=blendprograms_5,
    Data9=blendprograms_5,
    Data10=blendprograms_3,
    Data11=blendprograms,
    Data12="2013::StripMall::Type 2",
    Data13=blendprograms)  # -> simplify(graft(Result))

# ----
# Create Buildings
buildingfootprint = DFBuildingFromFootprint(
    footprint_geo=footprints,
    floor_to_floor=dup,
    perim_offset=perimeter_depth_m,
    name=data,
    program=merge,
    constr_set=data_2,
    run=Toggle(True))  # -> report, buildings; plug-in component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
topbottom = DFSeparateTopBottom(buildings=buildingfootprint.buildings)  # -> simplify(buildings); plug-in component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

# ----
# Assign Windows
window_ratios_per_building = Panel("""0.2
0.35
0.3
0.3
0.3
0.3
0.7
0.6
0.6
0.35
0.3
0.25
0.4""")
simpleratiopar = DFSimpleWindowRatioParameters(ratio=window_ratios_per_building)  # -> simplify(graft(win_par)); plug-in component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
applyfacadepar = DFApplyFacadeParameters(df_obj=topbottom, win_par=simpleratiopar)  # -> report, df_obj; plug-in component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

# ----
# Assign HVAC
hvac_templates = Panel("""VAV_Chiller_Boiler
VAV_Chiller_Boiler
PTAC_BoilerBaseboard
PTAC_BoilerBaseboard
PTAC_BoilerBaseboard
PTAC_BoilerBaseboard
VAV_Chiller_Boiler
VAV_Chiller_Boiler
VAV_Chiller_Boiler
VAV_Chiller_Boiler
PTAC_BoilerBaseboard
VAV_Chiller_Boiler
PTAC_BoilerBaseboard""")
data_3 = Data(simplify(graft(hvac_templates)))
dfallairhvac = DFAllAirHVAC(df_objs=applyfacadepar.df_obj, system_type=data_3, name=data_3)  # -> report, df_objs; plug-in component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

# ----
# Create Model
panel_11 = Panel("Buffalo New Development")
model = DFModel(buildings=flatten(dfallairhvac.df_objs), name=panel_11)  # -> report, model; plug-in component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

# ----
# Simulation Parameters
toggle = BooleanToggle(True)
simoutput = HBSimulationOutput(zone_energy_use=toggle, hvac_energy_use=toggle)  # -> report, sim_output; plug-in component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
panel_12 = Panel("https://www.energyplus.net/weather-download/north_and_central_america_wmo_region_4/USA/NY/USA_NY_Buffalo-Greater.Buffalo.Intl.AP.725280_TMY/all")
customoutput = HBCustomSimulationOutput(base_sim_output=simoutput.sim_output, output_names="Exterior Equipment Electricity Energy")  # -> report, sim_output; plug-in component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
downloadepw = LBDownloadWeather(weather_URL=panel_12)  # -> epw_file, stat_file, ddy_file; plug-in component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
simpar = HBSimulationParameter(output=customoutput.sim_output, timestep="1")  # -> sim_par; plug-in component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

# ----
# Visualize Model Properties
room2dattr = DFRoom2DAttributes({"Display Name": "display_name", "Simulation Name (Identifier)": "identifier", "Floor-To-Ceiling Height": "floor_to_ceiling_height", "Floor Elevation": "floor_height", "Ceiling Elevation": "ceiling_height", "Is Ground Contact": "is_ground_contact"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}, selected="Program": "properties.energy.program_type.display_name")
data_4 = Data(flatten(model.model))
colorroom2dattr = DFColorRoom2DAttributes(df_obj=flatten(data_4), attribute=room2dattr)  # -> mesh, legend, wire_frame, values, colors; plug-in component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

# ----
# Load the EV Measure
# EV Chg Station Types (aligned with buildings): Typical Public
# Typical Public
# Typical Home
# Typical Home
# Typical Home
# Typical Home
# Typical Work
# Typical Work
# Typical Work
# Typical Public
# Typical Home
# Typical Public
# Typical Home
panel_13 = Panel("C:\Users\chris\Documents\GitHub\dragonfly-grasshopper\samples\Add_EV_Load")
ev_percent = Panel("50")
loadmapper = DFLoadMapperMeasure()  # -> report, mapper; plug-in component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

# ----
# Write geoJSON
directory_into_which_files_will_be_writt = Panel("C:\ladybug\buffalo_district")  # "Directory into which files will be written"
constrloc = LBConstructLocation(name="Buffalo, NY", latitude="42.813153", longitude="-78.852466", time_zone="-5", elevation="200")  # -> location; plug-in component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
pt = Point(Point(0, 0, 0))
togeojson = DFModelToGeoJSON(
    model=model.model,
    location=constrloc,
    point=pt,
    use_multiplier=Toggle(False),
    shade_dist="50",
    folder=directory_into_which_files_will_be_writt,
    write=Toggle(False))  # -> report, geojson, hb_jsons, hb_models; plug-in component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

# ----
# Run Simulation
panel_14 = Panel("14")
runurbanopt = DFRunURBANopt(geojson=togeojson.geojson, epw_file=downloadepw.epw_file, sim_par=simpar, cpus=panel_14, run=Toggle(False))  # -> report, scenario, osm, idf, sql, zsz, rdd, html; plug-in component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

# ----
# Compute EUI
toggle_2 = BooleanToggle(True)
eui = HBEndUseIntensity(sql=runurbanopt.sql, ip=toggle_2)  # -> eui, eui_end_use, end_uses, gross_floor; plug-in component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
eui_kbtu_ft2 = Panel(eui.eui)
panel_15 = Panel(eui.eui_end_use)
panel_16 = Panel(eui.end_uses)

# ----
# Visualize Hourly Charging
panel_17 = Panel("Exterior Equipment Electricity Energy")
customresult = HBReadCustomResult(sql=runurbanopt.sql, output_names=panel_17)  # -> results; plug-in component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
hourlyplot = LBHourlyPlot(data=flatten(customresult), base_pt="0,-100,0")  # -> report, mesh, legend, borders, labels, title; plug-in component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
