# Grasshopper definition open_dss_example.gh (Grasshopper 1.0.7)

# ----
# Create Blended Building Programs
panel = Panel("""2013::Retail::Retail
2013::SmallOffice::ClosedOffice
2013::SmallOffice::Conference
2013::SmallOffice::Corridor
2013::SmallOffice::OpenOffice""")
panel_2 = Panel("""0.4
0.1
0.05
0.2
0.25""")
bldgprograms = HBBuildingPrograms({"LargeOffice", "MediumOffice", "SmallOffice", "MidriseApartment", "HighriseApartment", "Retail", "StripMall", "PrimarySchool", "SecondarySchool", "SmallHotel", "LargeHotel", "Hospital", "Outpatient", "Laboratory", "Warehouse", "SuperMarket", "FullServiceRestaurant", "QuickServiceRestaurant", "Courthouse", "LargeDataCenterHighITE", "LargeDataCenterLowITE", "SmallDataCenterHighITE", "SmallDataCenterLowITE"}, selected="Outpatient")
bldgprograms_2 = HBBuildingPrograms({"LargeOffice", "MediumOffice", "SmallOffice", "MidriseApartment", "HighriseApartment", "Retail", "StripMall", "PrimarySchool", "SecondarySchool", "SmallHotel", "LargeHotel", "Hospital", "Outpatient", "Laboratory", "Warehouse", "SuperMarket", "FullServiceRestaurant", "QuickServiceRestaurant", "Courthouse", "LargeDataCenterHighITE", "LargeDataCenterLowITE", "SmallDataCenterHighITE", "SmallDataCenterLowITE"}, selected="FullServiceRestaurant")
bldgprograms_3 = HBBuildingPrograms({"LargeOffice", "MediumOffice", "SmallOffice", "MidriseApartment", "HighriseApartment", "Retail", "StripMall", "PrimarySchool", "SecondarySchool", "SmallHotel", "LargeHotel", "Hospital", "Outpatient", "Laboratory", "Warehouse", "SuperMarket", "FullServiceRestaurant", "QuickServiceRestaurant", "Courthouse", "LargeDataCenterHighITE", "LargeDataCenterLowITE", "SmallDataCenterHighITE", "SmallDataCenterLowITE"}, selected="MidriseApartment")
bldgprograms_4 = HBBuildingPrograms({"LargeOffice", "MediumOffice", "SmallOffice", "MidriseApartment", "HighriseApartment", "Retail", "StripMall", "PrimarySchool", "SecondarySchool", "SmallHotel", "LargeHotel", "Hospital", "Outpatient", "Laboratory", "Warehouse", "SuperMarket", "FullServiceRestaurant", "QuickServiceRestaurant", "Courthouse", "LargeDataCenterHighITE", "LargeDataCenterLowITE", "SmallDataCenterHighITE", "SmallDataCenterLowITE"}, selected="StripMall")
bldgprograms_5 = HBBuildingPrograms({"LargeOffice", "MediumOffice", "SmallOffice", "MidriseApartment", "HighriseApartment", "Retail", "StripMall", "PrimarySchool", "SecondarySchool", "SmallHotel", "LargeHotel", "Hospital", "Outpatient", "Laboratory", "Warehouse", "SuperMarket", "FullServiceRestaurant", "QuickServiceRestaurant", "Courthouse", "LargeDataCenterHighITE", "LargeDataCenterLowITE", "SmallDataCenterHighITE", "SmallDataCenterLowITE"}, selected="MediumOffice")
blendprograms = HBBlendProgramTypes(name="Mixed Use Building Program", programs=panel, ratios=panel_2)  # -> program; plug-in component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

# ----
# Construction Set
bldg_vintage = Dragonfly_BldgAge({"ASHRAE 90.1 2013  |  IECC 2015": "2013", "ASHRAE 90.1 2010  |  IECC 2012": "2010", "ASHRAE 90.1 2007  |  IECC 2009": "2007", "ASHRAE 90.1 2004  |  IECC 2006": "2004", "1980-2004 (CBECS)": "1980_2004", "Pre-1980 (CBECS)": "pre_1980"}, selected="ASHRAE 90.1 2013  |  IECC 2015")
constr_type = Dragonfly_BldgAge({"SteelFramed", "WoodFramed", "Mass", "Metal Building"}, selected="SteelFramed")
climate_zone = Dragonfly_BldgAge({"1 - Very Hot": "1", "2 - Hot": "2", "3 - Warm": "3", "4 - Mixed": "4", "5 - Cool": "5", "6 - Cold": "6", "7 - Very Cold": "7", "8 - Subarctic": "8"}, selected="5 - Cool")
constrsetclimate = HBConstructionSetByClimate(climate_zone=climate_zone, vintage=bldg_vintage, constr_type=constr_type)  # -> constr_set; plug-in component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
data = Data(constrsetclimate)

# ----
# Basic Building Properties
building_names = Panel("""Mixed_use 1
Restaurant 1
Residential 1
Residential 2
Residential 4
Residential 5
Office 1
Hospital 1
Hospital 2
Mixed use 2
Residential 3
Mall 1
Residential 6""")
floor_to_floor_m = Panel("3.5")
number_of_stories = Panel("""4
1
3
3
1
1
6
10
3
8
3
3
10""")
footprints = Geometry(simplify(graft([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])))
perimeter_depth_m = Panel("10")
dup = DuplicateData(Data=floor_to_floor_m, Number=number_of_stories, Order=True)  # -> simplify(Data)
data_2 = Data(simplify(graft(building_names)))

# ----
# Order Programs
# to Match Footprints
merge = Merge(
    Data1=blendprograms,
    Data2=bldgprograms_2,
    Data3=bldgprograms_3,
    Data4=bldgprograms_3,
    Data5=bldgprograms_3,
    Data6=bldgprograms_3,
    Data7=bldgprograms_5,
    Data8=bldgprograms,
    Data9=bldgprograms,
    Data10=blendprograms,
    Data11=bldgprograms_3,
    Data12=bldgprograms_4,
    Data13=bldgprograms_3)  # -> simplify(graft(Result))

# ----
# Create Buildings
buildingfootprint = DFBuildingFromFootprint(
    footprint_geo=footprints,
    floor_to_floor=dup,
    perim_offset=perimeter_depth_m,
    name=data_2,
    program=merge,
    constr_set=data,
    run=Toggle(True))  # -> report, buildings; plug-in component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
topbottom = DFSeparateTopBottom(buildings=buildingfootprint.buildings)  # -> simplify(buildings); plug-in component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

# ----
# Assign Windows
window_ratios_per_building = Panel("""0.2
0.35
0.3
0.3
0.3
0.3
0.7
0.6
0.6
0.35
0.3
0.25
0.4""")
simpleratiopar = DFSimpleWindowRatioParameters(ratio=window_ratios_per_building)  # -> simplify(graft(win_par)); plug-in component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
applyfacadepar = DFApplyFacadeParameters(df_obj=topbottom, win_par=simpleratiopar)  # -> report, df_obj; plug-in component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

# ----
# Search Transformers + PowerLines
searchopendss = DFSearchOpenDSS()  # -> transformers, power_lines, wires; plug-in component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
panel_3 = Panel(searchopendss.power_lines)
panel_4 = Panel(searchopendss.transformers)

# ----
# Assign HVAC
hvac_templates = Panel("""VAV_Chiller_Boiler
VAV_Chiller_Boiler
PTAC_BoilerBaseboard
PTAC_BoilerBaseboard
PTAC_BoilerBaseboard
PTAC_BoilerBaseboard
VAV_Chiller_Boiler
VAV_Chiller_Boiler
VAV_Chiller_Boiler
VAV_Chiller_Boiler
PTAC_BoilerBaseboard
VAV_Chiller_Boiler
PTAC_BoilerBaseboard""")
data_3 = Data(simplify(graft(hvac_templates)))
dfallairhvac = DFAllAirHVAC(df_objs=applyfacadepar.df_obj, system_type=data_3)  # -> report, df_objs; plug-in component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

# ----
# Electric Connectors
panel_5 = Panel("3P_OH_AL_ACSR_477kcmil_Hawk_12_47_0")
wires_type_2 = Geometry([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])
wires_type_1 = Geometry([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])
connector = DFElectricalConnector(geo=wires_type_2, power_line="3P_UG_AL_750kcmil_15_0_480_0", name="Secondary_Lines")  # -> connector; plug-in component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
connector_2 = DFElectricalConnector(geo=wires_type_1, power_line=panel_5, name="Primary_Lines")  # -> connector; plug-in component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

# ----
# Transformers + Substation
transformer_properties = Panel("""PM3_4_12_47_0_480
PM3_6_12_47_0_480
PM3_6_12_47_0_480""")
panel_6 = Panel("""NorthWest_Transformer
SouthWest_Transformer
SouthEasr_Transformer""")
transformers = Geometry([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])
substation = Geometry(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)
transformer = DFTransformer(geo=transformers, properties=transformer_properties, name=panel_6)  # -> transformer; plug-in component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
substation_2 = DFSubstation(geo=substation)  # -> substation; plug-in component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

# ----
# Create Model
panel_7 = Panel("Buffalo New Development GEB")
model = DFModel(buildings=flatten(dfallairhvac.df_objs), name=panel_7)  # -> report, model; plug-in component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

# ----
# Visualize Model Properties
panel_8 = Panel("22")
colrange = LBColorRange(index=panel_8)  # -> colors; plug-in component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
pt = Point(Point(-476.9475201, 578.8204416, 0))
legendpar = LBLegendParameters(colors=colrange, base_plane=pt, seg_height="40")  # -> leg_par; plug-in component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
room2dattr = DFRoom2DAttributes({"Display Name": "display_name", "Simulation Name (Identifier)": "identifier", "Floor-To-Ceiling Height": "floor_to_ceiling_height", "Floor Elevation": "floor_height", "Ceiling Elevation": "ceiling_height", "Is Ground Contact": "is_ground_contact"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}, selected="Program": "properties.energy.program_type.display_name")
data_4 = Data(flatten(model.model))
colorroom2dattr = DFColorRoom2DAttributes(df_obj=flatten(data_4), attribute=room2dattr, legend_par=legendpar)  # -> mesh, legend, wire_frame, values, colors; plug-in component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

# ----
# Create Electric
# Infrastructure
network = DFElectricalNetwork(substation=substation_2, transformers=flatten(transformer), connectors=flatten([connector_2, connector]))  # -> report, network; plug-in component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

# ----
# Download EPW File
panel_9 = Panel("https://energyplus-weather.s3.amazonaws.com/north_and_central_america_wmo_region_4/USA/NY/USA_NY_Buffalo-Greater.Buffalo.Intl.AP.725280_TMY/USA_NY_Buffalo-Greater.Buffalo.Intl.AP.725280_TMY.zip")
analysisperiod = LBAnalysisPeriod(start_month="7", start_day=1, start_hour=0, end_month="7")  # -> period, hoys, dates; plug-in component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
downloadepw = LBDownloadWeather(weather_URL=panel_9)  # -> epw_file, stat_file, ddy_file; plug-in component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
simpar = HBSimulationParameter(run_period=analysisperiod.period, timestep="1")  # -> sim_par; plug-in component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

# ----
# Visualize Electric
# Infrastructure Properties
panel_10 = Panel("23")
colrange_2 = LBColorRange(index=panel_10)  # -> colors; plug-in component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
data_5 = Data(flatten(network.network))
pt_2 = Point(Point(841.34085, 16.17730859, 0))
newtworkattr = DFRoom2DAttributes({"Display Name": "display_name", "Simulation Name (Identifier)": "identifier", "Nominal Voltage": "nominal_voltage", "Phase Count": "phase_count", "Wire Count": "power_line.wire_count", "Wire Phases": "power_line.phases", "Transformer kVA": "properties.kva", "Transformer Reactance": "properties.reactance"}, selected="Transformer kVA")
legendpar_2 = LBLegendParameters(colors=colrange_2, base_plane=pt_2)  # -> leg_par; plug-in component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
colornetattr = DFColorNetworkAttributes(network=data_5, attribute=newtworkattr, legend_par=legendpar_2)  # -> vis_geo, legend, values, colors; plug-in component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

# ----
# Write geoJSON
panel_11 = Panel("-78.852466")
constrloc = LBConstructLocation(name="Buffalo, NY", latitude="42.813153", longitude=panel_11, time_zone="-5", elevation="200")  # -> location; plug-in component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
pt_3 = Point(Point(0, 0, 0))
togeojson = DFModelToGeoJSON(
    model=model.model,
    location=constrloc,
    point=pt_3,
    use_multiplier=Toggle(False),
    shade_dist="50",
    network=network.network,
    write=Toggle(False))  # -> report, geojson, net_json, hb_jsons, hb_models; plug-in component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

# ----
# Run Simulation
runurbanopt = DFRunURBANopt(geojson=togeojson.geojson, epw_file=downloadepw.epw_file, sim_par=simpar, run=Toggle(False))  # -> report, scenario, osm, idf, sql, zsz, rdd, html; plug-in component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

# ----
# Compute EUI
# (just over run period)
toggle = BooleanToggle(True)
eui = HBEndUseIntensity(sql=runurbanopt.sql, ip=toggle)  # -> eui, eui_end_use, end_uses, gross_floor; plug-in component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
eui_kbtu_ft2 = Panel(eui.eui)
panel_12 = Panel(eui.eui_end_use)
panel_13 = Panel(eui.end_uses)

path = FilePath(togeojson.geojson)
path_2 = FilePath(runurbanopt.scenario)

# ----
# Run OpenDSS
runopendss = DFRunOpenDSS(geojson=path, scenario=path_2, run=Toggle(False))  # -> report, buildings, connectors, transformers; plug-in component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

path_3 = FilePath([runopendss.transformers, runopendss.connectors])

opendssresult = DFReadOpenDSSResult(dss_csv=path_3)  # -> factors, condition; plug-in component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

# ----
# Visualize Spatial
# Results
panel_14 = Panel("12")
path_4 = FilePath(togeojson.net_json)
colrange_3 = LBColorRange(index=panel_14)  # -> colors; plug-in component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
legendpar_3 = LBLegendParameters(min="0", max="1.6", seg_count="9", colors=colrange_3, num_decimals="1")  # -> leg_par; plug-in component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
loadobjects = DFLoadObjects(df_file=path_4, load=Toggle(True))  # -> report, df_objs; plug-in component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
colornetresults = DFColorNetworkResults(data=flatten(opendssresult.factors), network=loadobjects.df_objs, legend_par=legendpar_3)  # -> vis_geo, legend, title, values, colors; plug-in component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

# ----
# Visualize
# Hourly Results
panel_15 = Panel("-500,300,0")
hourlyplot = LBHourlyPlot(data=opendssresult.factors, base_pt=panel_15, x_dim="4")  # -> report, mesh, legend, borders, labels, title; plug-in component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
