# Grasshopper definition sloped_roof_residential.gh (Grasshopper 1.0.7)

building_massing_geometries = Geometry([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])

# ----
# Create the Base Building
panel = Panel("2019::MidriseApartment::Apartment")
buildingsolid = DFBuildingFromSolid(bldg_geo=flatten(building_massing_geometries), floor_to_floor="3", program=panel, run=Toggle(True))  # -> report, buildings; plug-in component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
repeatingwhpar = DFRepeatingWindowWidthHeightParameters(win_height="1.8", win_width="1")  # -> win_par; plug-in component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
applyfacadepar = DFApplyFacadeParameters(df_obj=buildingsolid.buildings, win_par=repeatingwhpar)  # -> report, df_obj; plug-in component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
topbottom = DFSeparateTopBottom(buildings=flatten(applyfacadepar.df_obj))  # -> buildings; plug-in component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

# ----
# Create a Building from Custom Honeybee Rooms
bldgprograms = HBBuildingPrograms({"LargeOffice", "MediumOffice", "SmallOffice", "MidriseApartment", "HighriseApartment", "Retail", "StripMall", "PrimarySchool", "SecondarySchool", "SmallHotel", "LargeHotel", "Hospital", "Outpatient", "Laboratory", "Warehouse", "SuperMarket", "FullServiceRestaurant", "QuickServiceRestaurant", "Courthouse", "College", "LargeDataCenterHighITE", "LargeDataCenterLowITE", "SmallDataCenterHighITE", "SmallDataCenterLowITE"}, selected="SmallOffice")
geo = Geometry([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])
roomsolid = HBRoomFromSolid(geo=flatten(geo), program=bldgprograms, conditioned=True)  # -> report, rooms; plug-in component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
toggle = BooleanToggle(True)
intsolid = HBIntersectSolids(rooms=flatten(roomsolid.rooms), run=toggle)  # -> int_rooms; plug-in component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
solveadj = HBSolveAdjacency(rooms=flatten(intsolid), run=toggle)  # -> report, adj_rooms; plug-in component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
aperturesbyratio = HBAperturesByRatio(hb_objs=flatten(solveadj.adj_rooms), ratio="0.4")  # -> report, hb_objs; plug-in component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
buildinghbrooms = DFBuildingFromDetailedRooms(hb_rooms=aperturesbyratio.hb_objs, name="Boutique Small Office")  # -> report, building; plug-in component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

# ----
# Extract Upward-Facing Geometries
debrep = DeconstructBrep(Brep=building_massing_geometries)  # -> Faces, Edges, Vertices
evalsrf = EvaluateSurface(Surface=debrep.Faces, Point="0,0")  # -> Point, Normal, UDirection, VDirection, Frame
Z = UnitZ(Factor=1)
angle = Angle(VectorA=Z, VectorB=evalsrf.Normal)  # -> Angle, Reflex
rad = Radians(Degrees="89")
smaller = SmallerThan(FirstNumber=angle.Angle, SecondNumber=rad)  # -> SmallerThan, OrEqualTo
dispatch = Dispatch(List=debrep.Faces, DispatchPattern=smaller.SmallerThan)  # -> ListA, ListB

# ----
# Apply Sloped Roofs
buildings = Data(simplify(graft(topbottom)))
roof_geo = Geometry(simplify(dispatch.ListA))
applyroof = DFApplyRoof(df_obj=buildings, roof_geo=roof_geo)  # -> df_obj; plug-in component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

model = DFModel(buildings=flatten([applyroof, buildinghbrooms.building]))  # -> report, model; plug-in component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

# ----
# Visualize Model in 3D
toggle_2 = BooleanToggle(True)
tohoneybee = DFModelToHoneybee(model=model.model, obj_per_model="District", run=toggle_2)  # -> report, hb_models; plug-in component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
vizbytype = HBVisualizeByType(hb_objs=tohoneybee.hb_models)  # -> walls, interior_walls, roofs, ceilings, exterior_floors, interior_floors, air_walls, apertures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; plug-in component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
